# Dynamo graph 11 Slovenia.dyn (Dynamo 1.3.3.4111)

siteLocation = SiteLocation()
string_from_object = FromObject(siteLocation)
code_block = CodeBlock(site=string_from_object) { t= String.Split(site, {" ", ","}); lat=t[1]; lon=t[2]; }
code_block_2 = CodeBlock { "4326"; "3912"; }
code_block_3 = CodeBlock { "Dunajska cesta"; "18"; "Ljubljana"; "Slovenia"; }
geocodingNomatimAPI = Custom[GIS2BIM.GeocodingNomatimAPI](Streetname=code_block_3.out0, Housenumber=code_block_3.out1, Place=code_block_3.out2, Country=code_block_3.out3)  # gets WGS-84 coordinate from address with Open Streets Maps API
watch = Watch(geocodingNomatimAPI.longitude)
watch_2 = Watch(geocodingNomatimAPI.latitude)
transformCRS_epsg = Custom[GIS2BIM.TransformCRS_epsg](sourceCRS=code_block_2.out0, targetCRS=code_block_2.out1, xCoordinate=watch, yCoordinate=watch_2)  # Uses the API of http://epsg.io to transform Coordinate Reference Systems
code_block_4 = CodeBlock { 400; }
createBoundingBox = Custom[GIS2BIM.CreateBoundingBox](CoordinateX=transformCRS_epsg.Xtransformed, CoordinateY=transformCRS_epsg.Ytransformed, BoxWidth=code_block_4, BoxHeight=code_block_4)  # create boundingboxstring for webrequests based on coördinates and dimensions
sloveniaGeoservicesLibrary = Custom[GIS2BIM.SloveniaGeoservicesLibrary](Boundingboxstring_EPSG_3912=createBoundingBox.Boxstring)  # Geoservices in Slovenia
code_block_5 = CodeBlock { "WFS_USER"; "testWFSelf"; }
webrequestCredentials = Custom[GIS2BIM.WebrequestCredentials](url=sloveniaGeoservicesLibrary.Cadastral_Parcels_OGC_WFS, username=code_block_5.out0, password=code_block_5.out1)  # Webrequest with username and password
boolean = BoolSelector(false)
createPointsPolygonFromGMLxy = Custom[GIS2BIM.CreatePointsPolygonFromGMLxy](XML=webrequestCredentials, DeltaX=transformCRS_epsg.Xtransformed, DeltaY=transformCRS_epsg.Ytransformed, Connectpolygon=boolean)  # Create point and polygons from a GML-file
watch_3 = Watch()  # frozen; unwired: arg0
code_block_6 = CodeBlock { ".//{http://www.opengis.net/gml/3.2}posList"; }
create = List.Create(code_block_6)
XMLXPath = Custom[GIS2BIM.XMLXPath](XMLString=watch_3, XPathStrings=create)  # Run an XPathquery on an xml-string
