# Dynamo graph 3 Geocoding.dyn (Dynamo 1.3.3.4111)

code_block = CodeBlock { "Dunajska cesta"; "18"; "Ljubljana"; "Slovenia"; }
geoCodingGoogleAPI = Custom[GIS2BIM.GeoCodingGoogleAPI](Streetname=code_block.out0, Housenumber=code_block.out1, Place=code_block.out2, Country=code_block.out3)  # gets coordinate from adress with google API
openBrowser = Custom[GIS2BIM.OpenBrowser](url=geoCodingGoogleAPI.GoogleAPILink)  # Opens a new window in your default browser with the given url.
