# Dynamo graph 4 Coordinate Reference Systems.dyn (Dynamo 1.3.3.4111)

code_block = CodeBlock { "3912"; }
searchCRS = Custom[GIS2BIM.SearchCRS](EPSG_Code=code_block)  # Search for a Coordinate Reference System
siteLocation = SiteLocation()
string_from_object = FromObject(siteLocation)
code_block_2 = CodeBlock(site=string_from_object) { t= String.Split(site, {" ", ","}); lat=t[1]; lon=t[2]; }
code_block_3 = CodeBlock { "4326"; "3912"; }
code_block_4 = CodeBlock { "Dunajska cesta"; "18"; "Ljubljana"; "Slovenia"; }
geocodingNomatimAPI = Custom[GIS2BIM.GeocodingNomatimAPI](Streetname=code_block_4.out0, Housenumber=code_block_4.out1, Place=code_block_4.out2, Country=code_block_4.out3)  # gets WGS-84 coordinate from address with Open Streets Maps API
watch = Watch(geocodingNomatimAPI.longitude)
watch_2 = Watch(geocodingNomatimAPI.latitude)
transformCRS_epsg = Custom[GIS2BIM.TransformCRS_epsg](sourceCRS=code_block_3.out0, targetCRS=code_block_3.out1, xCoordinate=watch, yCoordinate=watch_2)  # Uses the API of http://epsg.io to transform Coordinate Reference Systems
code_block_5 = CodeBlock { 400; }
createBoundingBox = Custom[GIS2BIM.CreateBoundingBox](CoordinateX=transformCRS_epsg.Xtransformed, CoordinateY=transformCRS_epsg.Ytransformed, BoxWidth=code_block_5, BoxHeight=code_block_5)  # create boundingboxstring for webrequests based on coördinates and dimensions
createBoundingBoxLATLONG = Custom[GIS2BIM.CreateBoundingBoxLATLONG](Lat=watch_2, Long=watch, WidthMeters=code_block_5)  # create boundingbox with from lat/long coordinate in degrees
