# Dynamo graph 5 WMS extra examples.dyn (Dynamo 1.3.3.4111)

siteLocation = SiteLocation()
code_block = CodeBlock { "dordrecht"; "werf van schouten"; "503"; }
getLocationdataNetherlands = Custom[GIS2BIM.GetLocationdataNetherlands](City=code_block.out0, Streetname=code_block.out1, Housenumber=code_block.out2)  # Gives locationdata based on an adress in the Netherlands
code_block_2 = CodeBlock { 200; }
createBoundingBox = Custom[GIS2BIM.CreateBoundingBox](CoordinateX=getLocationdataNetherlands.RDcoordinateX_meters_double, CoordinateY=getLocationdataNetherlands.RDcoordinateY_meters_double, BoxWidth=code_block_2, BoxHeight=code_block_2)  # create boundingboxstring for webrequests based on coördinates and dimensions
geoservicesLibraryNetherlands = Custom[GIS2BIM.GeoservicesLibraryNetherlands](BoundingBox=createBoundingBox.Boxstring)  # Library with multiple webadresses which can be used for WFS and WMS webrequests
webrequestWMS2 = Custom[GIS2BIM.WebrequestWMS2](WMSwebrequest=geoservicesLibraryNetherlands.5_luchtfoto_2016_OGC_WMS)  # a webrequest based on WMS-protocol
watch_image = WatchImageCore(webrequestWMS2)
webrequestWMS2_2 = Custom[GIS2BIM.WebrequestWMS2](WMSwebrequest=geoservicesLibraryNetherlands.Luchtfoto_2017_OGC_WMS)
watch_image_2 = WatchImageCore(webrequestWMS2_2)
webrequestWMS2_3 = Custom[GIS2BIM.WebrequestWMS2](WMSwebrequest=geoservicesLibraryNetherlands.12_ruimtelijkeplannen_OGC_WMS)
watch_image_3 = WatchImageCore(webrequestWMS2_3)
