# Dynamo graph 5 WMS.dyn (Dynamo 1.3.3.4111)

code_block = CodeBlock { "3912"; }
searchCRS = Custom[GIS2BIM.SearchCRS](EPSG_Code=code_block)  # Search for a Coordinate Reference System
siteLocation = SiteLocation()
string_from_object = FromObject(siteLocation)
code_block_2 = CodeBlock(site=string_from_object) { t= String.Split(site, {" ", ","}); lat=t[1]; lon=t[2]; }
code_block_3 = CodeBlock { "4326"; "3912"; }
code_block_4 = CodeBlock { "Dunajska cesta"; "18"; "Ljubljana"; "Slovenia"; }
geocodingNomatimAPI = Custom[GIS2BIM.GeocodingNomatimAPI](Streetname=code_block_4.out0, Housenumber=code_block_4.out1, Place=code_block_4.out2, Country=code_block_4.out3)  # gets WGS-84 coordinate from address with Open Streets Maps API
watch = Watch(geocodingNomatimAPI.longitude)
watch_2 = Watch(geocodingNomatimAPI.latitude)
transformCRS_epsg = Custom[GIS2BIM.TransformCRS_epsg](sourceCRS=code_block_3.out0, targetCRS=code_block_3.out1, xCoordinate=watch, yCoordinate=watch_2)  # Uses the API of http://epsg.io to transform Coordinate Reference Systems
code_block_5 = CodeBlock { 400; }
createBoundingBox = Custom[GIS2BIM.CreateBoundingBox](CoordinateX=transformCRS_epsg.Xtransformed, CoordinateY=transformCRS_epsg.Ytransformed, BoxWidth=code_block_5, BoxHeight=code_block_5)  # create boundingboxstring for webrequests based on coördinates and dimensions
sloveniaGeoservicesLibrary = Custom[GIS2BIM.SloveniaGeoservicesLibrary](Boundingboxstring_EPSG_3912=createBoundingBox.Boxstring)  # Geoservices in Slovenia
code_block_6 = CodeBlock()
# ---------- code_block_6.designscript (11 lines) ----------
"https://prostor4.gov.si/";
"ows2-ins-m/inspire_oi/ows?service=wms";
"&request=GetMap";
"&VERSION=1.3.0";
"&STYLES=OI.OrthoimageCoverage.Default";
"&layers=OI.OrthoimageCoverage";
"&bbox=";
"&width=3000";
"&height=3000";
"&format=image/png";
"&crs=EPSG:3912";
# ----------------------------------------
code_block_7 = CodeBlock()
# ---------- code_block_7.designscript (3 lines) ----------
//SLOVENIA WMS

SEWERS="ows2-ins-m/inspire_us-net-sw/ows?SERVICE=WMS";
# ----------------------------------------
concat = String.Concat(code_block_6.out0, code_block_7, code_block_6.out2, code_block_6.out3, code_block_6.out4, code_block_6.out5, code_block_6.out6, createBoundingBox.Boxstring, code_block_6.out7, code_block_6.out8, code_block_6.out9, code_block_6.out10)
webrequestWMS2 = Custom[GIS2BIM.WebrequestWMS2](WMSwebrequest=concat)  # a webrequest based on WMS-protocol
watch_image = WatchImageCore(webrequestWMS2)
views = Views("Cadastre WMS")
code_block_8 = CodeBlock()
# ---------- code_block_8.designscript (11 lines) ----------
"https://prostor4.gov.si/";
"ows2-elf-m/elf_cp/ows?service=wms";
"&request=GetMap";
"&VERSION=1.3.0";
"&STYLES=CP.CadastralParcel.ELFCadastre";
"&layers=CP.CadastralParcel";
"&bbox=";
"&width=3000";
"&height=3000";
"&format=image/png";
"&crs=EPSG:3912";
# ----------------------------------------
concat_2 = String.Concat(code_block_8.out0, code_block_8.out1, code_block_8.out2, code_block_8.out3, code_block_8.out4, code_block_8.out5, code_block_8.out6, createBoundingBox.Boxstring, code_block_8.out7, code_block_8.out8, code_block_8.out9, code_block_8.out10)
webrequestWMS2_2 = Custom[GIS2BIM.WebrequestWMS2](WMSwebrequest=concat_2)
watch_image_2 = WatchImageCore(webrequestWMS2_2)
code_block_9 = CodeBlock { "C:/TEMP/SLOVENIA_CADASTER.png"; }
systemDrawingBitmapToJPG = Custom[GIS2BIM.SystemDrawingBitmapToJPG](SystemDrawingBitmap=watch_image_2, FileName=code_block_9)  # Save an System.Drawing.Bitmap object as a jpg-file
importImageInView = Custom[GIS2BIM.ImportImageInView](ImageWidthMeters=code_block_5, View=views, ImagePath=systemDrawingBitmapToJPG)  # Import rasterimage in view
