# Dynamo graph 5.4 Web Map Tile Service(WMTS).dyn (Dynamo 1.3.3.4111)

siteLocation = SiteLocation()
string_from_object = FromObject(siteLocation)
code_block = CodeBlock(site=string_from_object) { t= String.Split(site, {" ", ","}); lat=t[1]; lon=t[2]; }
code_block_2 = CodeBlock { "Dunajska cesta"; "18"; "Ljubljana"; "Slovenia"; }
geocodingNomatimAPI = Custom[GIS2BIM.GeocodingNomatimAPI](Streetname=code_block_2.out0, Housenumber=code_block_2.out1, Place=code_block_2.out2, Country=code_block_2.out3)  # gets WGS-84 coordinate from address with Open Streets Maps API
watch = Watch(geocodingNomatimAPI.latitude)
watch_2 = Watch(geocodingNomatimAPI.longitude)
code_block_3 = CodeBlock { 400; }
createBoundingBoxLATLONG = Custom[GIS2BIM.CreateBoundingBoxLATLONG](Lat=watch, Long=watch_2, WidthMeters=code_block_3)  # create boundingbox with from lat/long coordinate in degrees
code_block_4 = CodeBlock { 20; }
TMSGetTileNumbersFromBboxLATLON = Custom[GIS2BIM.TMSGetTileNumbersFromBboxLATLON](West=createBoundingBoxLATLONG.West, East=createBoundingBoxLATLONG.East, North=createBoundingBoxLATLONG.North, South=createBoundingBoxLATLONG.South, Zoomlevel=code_block_4, BoundingboxWidth=code_block_3)  # Get the Tilenumbers in X and Y in the TMS Webprotocol based on a given Boundingbox in LAT/LON
TMSWebServices = Custom[GIS2BIM.TMSWebServices](TileX=TMSGetTileNumbersFromBboxLATLON.TileX, TileY=TMSGetTileNumbersFromBboxLATLON.TileY, Zoomlevel=code_block_4)  # Library With TMS Webservices
boolean = BoolSelector(false)
TMS_WMTS_WebrequestAndCombineImages = Custom[GIS2BIM.TMS_WMTS_WebrequestAndCombineImages](URLlist=TMSWebServices.URL_Google_Terrain, UniqueTileNumbersColumnX=TMSGetTileNumbersFromBboxLATLON.TileXUnique, UniqueTileNumbersRowY=TMSGetTileNumbersFromBboxLATLON.TileYUnique, WMTSorTMS=boolean)  # Webrequest for list of WMTS or TMS/Google webrequests for tiles. Combines them to 1 image.
watch_image = WatchImageCore(TMS_WMTS_WebrequestAndCombineImages.Image)
systemDrawingBitmapToJPG = Custom[GIS2BIM.SystemDrawingBitmapToJPG](SystemDrawingBitmap=watch_image)  # Save an System.Drawing.Bitmap object as a jpg-file; unwired: FileName
views = Views("Google Roadmap")
TMS_WMTS_WebrequestAndCombineImages_2 = Custom[GIS2BIM.TMS_WMTS_WebrequestAndCombineImages](URLlist=TMSWebServices.URL_Google_Standard_Roadmap, UniqueTileNumbersColumnX=TMSGetTileNumbersFromBboxLATLON.TileXUnique, UniqueTileNumbersRowY=TMSGetTileNumbersFromBboxLATLON.TileYUnique, WMTSorTMS=boolean)
watch_image_2 = WatchImageCore(TMS_WMTS_WebrequestAndCombineImages_2.Image)
code_block_5 = CodeBlock { "C:/TEMP/GoogleEarth.png"; "C:/TEMP/GoogleRoad.png"; }
systemDrawingBitmapToJPG_2 = Custom[GIS2BIM.SystemDrawingBitmapToJPG](SystemDrawingBitmap=watch_image_2, FileName=code_block_5.out1)
importImageInView = Custom[GIS2BIM.ImportImageInView](ImageWidthMeters=code_block_3, View=views, ImagePath=systemDrawingBitmapToJPG_2)  # frozen; Import rasterimage in view
views_2 = Views("Google Earth")
TMS_WMTS_WebrequestAndCombineImages_3 = Custom[GIS2BIM.TMS_WMTS_WebrequestAndCombineImages](URLlist=TMSWebServices.URL_Google_Earth_Satellite, UniqueTileNumbersColumnX=TMSGetTileNumbersFromBboxLATLON.TileXUnique, UniqueTileNumbersRowY=TMSGetTileNumbersFromBboxLATLON.TileYUnique, WMTSorTMS=boolean)
watch_image_3 = WatchImageCore(TMS_WMTS_WebrequestAndCombineImages_3.Image)
systemDrawingBitmapToJPG_3 = Custom[GIS2BIM.SystemDrawingBitmapToJPG](SystemDrawingBitmap=watch_image_3, FileName=code_block_5.out0)
importImageInView_2 = Custom[GIS2BIM.ImportImageInView](ImageWidthMeters=code_block_3, View=views_2, ImagePath=systemDrawingBitmapToJPG_3)  # frozen
