# Dynamo graph 6 WFS.dyn (Dynamo 1.3.3.4111)

siteLocation = SiteLocation()
string_from_object = FromObject(siteLocation)
code_block = CodeBlock(site=string_from_object) { t= String.Split(site, {" ", ","}); lat=t[1]; lon=t[2]; }
code_block_2 = CodeBlock { "Dunajska cesta"; "18"; "Ljubljana"; "Slovenia"; }
link_kadaster = CodeBlock()
# ---------- link_kadaster.designscript (5 lines) ----------
"http://geodata.nationaalgeoregister.nl/";
"kadastralekaartv3/wfs?";
"&request=GetFeature";
"&typeName=kadastralekaartv3:kadastralegrens";
"&bbox=";
# ----------------------------------------
code_block_3 = CodeBlock { "4326"; "28992"; }
code_block_4 = CodeBlock { "werf van schouten"; "501"; "Dordrecht"; "The Netherlands"; }
geocodingNomatimAPI = Custom[GIS2BIM.GeocodingNomatimAPI](Streetname=code_block_4.out0, Housenumber=code_block_4.out1, Place=code_block_4.out2, Country=code_block_4.out3)  # gets WGS-84 coordinate from address with Open Streets Maps API
watch = Watch(geocodingNomatimAPI.longitude)
watch_2 = Watch(geocodingNomatimAPI.latitude)
transformCRS_epsg = Custom[GIS2BIM.TransformCRS_epsg](sourceCRS=code_block_3.out0, targetCRS=code_block_3.out1, xCoordinate=watch, yCoordinate=watch_2)  # Uses the API of http://epsg.io to transform Coordinate Reference Systems
code_block_5 = CodeBlock { 400; }
createBoundingBox = Custom[GIS2BIM.CreateBoundingBox](CoordinateX=transformCRS_epsg.Xtransformed, CoordinateY=transformCRS_epsg.Ytransformed, BoxWidth=code_block_5, BoxHeight=code_block_5)  # create boundingboxstring for webrequests based on coördinates and dimensions
concat = String.Concat(link_kadaster.out0, link_kadaster.out1, link_kadaster.out2, link_kadaster.out3, link_kadaster.out4, createBoundingBox.Boxstring)
web_request = WebRequest(concat)
watch_3 = Watch(web_request)
boolean = BoolSelector(false)
createPointsPolygonFromGMLxy = Custom[GIS2BIM.CreatePointsPolygonFromGMLxy](XML=watch_3, DeltaX=transformCRS_epsg.Xtransformed, DeltaY=transformCRS_epsg.Ytransformed, Connectpolygon=boolean)  # Create point and polygons from a GML-file
code_block_6 = CodeBlock { ".//{http://www.opengis.net/gml/3.2}posList"; }
create = List.Create(code_block_6)
XMLXPath = Custom[GIS2BIM.XMLXPath](XMLString=watch_3, XPathStrings=create)  # Run an XPathquery on an xml-string
