# Dynamo graph 6.4 Download OSM.dyn (Dynamo 1.3.3.4111)

siteLocation = SiteLocation()
string_from_object = FromObject(siteLocation)
code_block = CodeBlock(site=string_from_object) { t= String.Split(site, {" ", ","}); lat=t[1]; lon=t[2]; }
code_block_2 = CodeBlock { "Dunajska cesta"; "18"; "Ljubljana"; "Slovenia"; }
geocodingNomatimAPI = Custom[GIS2BIM.GeocodingNomatimAPI](Streetname=code_block_2.out0, Housenumber=code_block_2.out1, Place=code_block_2.out2, Country=code_block_2.out3)  # gets WGS-84 coordinate from address with Open Streets Maps API
watch = Watch(geocodingNomatimAPI.latitude)
watch_2 = Watch(geocodingNomatimAPI.longitude)
code_block_3 = CodeBlock { 300; }
createBoundingBoxLATLONG = Custom[GIS2BIM.CreateBoundingBoxLATLONG](Lat=watch, Long=watch_2, WidthMeters=code_block_3)  # create boundingbox with from lat/long coordinate in degrees
code_block_4 = CodeBlock { "C:/TEMP"; }
downloadOSM = Custom[GIS2BIM.DownloadOSM](West=createBoundingBoxLATLONG.West, East=createBoundingBoxLATLONG.East, North=createBoundingBoxLATLONG.North, South=createBoundingBoxLATLONG.South, Directory=code_block_4)  # Download OSM data within a boundingbox
location = Elk.OSM.Location(downloadOSM.Location)
features = Elk.OSM.Features()
code_block_5 = CodeBlock(features=features) { features[5]; 10; features[9]; }
subFeatures = Elk.OSM.SubFeatures(code_block_5.out0, code_block_5.out1)
OSMData = Elk.OSM.OSMData(location.out0, location.out1, code_block_5.out0, subFeatures)

# group: 3D BUILDINGS
OSM3DBuilding = Custom[GIS2BIM.OSM3DBuilding](OSMBuildingpoints=OSMData.out0, OSMBuildingKeys=OSMData.out1)  # Filter OSM-data and look for buildings with 'height' parameter and create 3D solid
file_path = Filename("..\..\..\..\..\..\..\60_revit_bibliotheek\Family Templates\English\Conceptual Mass\Metric Mass.rft")
count = List.Count(OSM3DBuilding)  # frozen
code_block_6 = CodeBlock(n=count) { 1..n..1; }
string_from_object_2 = FromObject(code_block_6)
code_block_7 = CodeBlock { "OSM_building_"; }
concat = String.Concat(code_block_7)  # unwired: arg1
map = List.Map(list=string_from_object_2, f_x=concat)
categories = Categories("Mass")
byGeometry = Custom[Springs.FamilyInstance.ByGeometry](geometry=OSM3DBuilding, familyTemplatePath=file_path, familyName=map, category=categories)  # You must provide a valid family template path that will be used for all input geometry objects. The project units(and not the templates) will be used to determine the size of the output geometry. The provided category will be used only if the family template supports it. If not, the default template category will be used instead. Likewise, the family material(provided as a string) will be set only if a material with that name exists in the template. If not, the default material will be used instead ("By Category"). For void cuts, the material settings will be ignored. The Subcategory name is an optional input. If you'd like to skip assigning a Subcategory to any new instance, simply use null. The node expects a unique family name for each geometry object. The rest of the input lists will be processed as if the node lacing is set to longest.

# group: 2D BUILDINGS
views = Views("OSM")
byPoints = PolyCurve.ByPoints(points=OSMData.out0@L4)
flatten = Flatten(byPoints)
explode = Geometry.Explode(flatten)
select_filled_region_type = FilledRegionTypes("FP_DP_90_pand")
byCurves = FilledRegion.ByCurves(views, explode, select_filled_region_type)

subFeatures_2 = Elk.OSM.SubFeatures(code_block_5.out2, code_block_5.out1)

# group: OSM HIGHWAY 2D LINES
views_2 = Views("OSM")
OSMData_2 = Elk.OSM.OSMData(location.out0, location.out1, code_block_5.out2, subFeatures_2)
byPoints_2 = PolyCurve.ByPoints(points=OSMData_2)
flatten_2 = Flatten(byPoints_2)
bv_remove_nulls = Custom[bv Remove Nulls](List=flatten_2)  # forked from Lunchbox
code_block_8 = CodeBlock { "Thin Lines"; }
createDetailLinesFromPolygons = Custom[GIS2BIM.CreateDetailLinesFromPolygons](View=views_2, PolyCurves=bv_remove_nulls, Linestyle=code_block_8)  # Create detaillines from polygons in a view
