# Dynamo graph 8 NetherlandsGEO_Pointcloud.dyn (Dynamo 1.3.3.4111)

# group: INPUT
directory_laszip = CodeBlock { "C:/TEMP"; }
filepath_laz_pointcloud = Filename("..\..\..\..\..\..\..\..\TEMP\C_38CZ1.LAZ")
boundingbox = CodeBlock { 250; }
new_filename = CodeBlock { "BILT_cropped.laz"; }

code_block = CodeBlock { "Dordrecht"; "Lange Geldersekade"; "2"; }
getLocationdataNetherlands = Custom[GIS2BIM.GetLocationdataNetherlands](City=code_block.out0, Streetname=code_block.out1, Housenumber=code_block.out2)  # Gives locationdata based on an adress in the Netherlands

# group: CREATE BATCHFILE
code_block_2 = CodeBlock { "/"; "cropped3.bat"; }
concat = String.Concat(directory_laszip, code_block_2.out0, code_block_2.out1)
downloadLASZIP = Custom[GIS2BIM.DownloadLASZIP](Directory=directory_laszip)  # download and unzip laszip
code_block_3 = CodeBlock { " -i "; }
code_block_4 = CodeBlock { "-keep_classification 2 "; ""; " -oparse xyz"; }
string = StringInput("\"")
code_block_5 = CodeBlock { " -translate_x -"; " -translate_y -"; }
code_block_6 = CodeBlock(x=getLocationdataNetherlands.RDcoordinateX_meters_double, y=getLocationdataNetherlands.RDcoordinateY_meters_double, width=boundingbox) { x; y; width; }
toString = Custom[Springs.Number.ToString](num=code_block_6.x)  # Converts the input number(s) to string. You can optionally limit the number of digits.
toString_2 = Custom[Springs.Number.ToString](num=code_block_6.y)
code_block_7 = CodeBlock { " -inside "; " "; }
code_block_8 = CodeBlock(x=code_block_6.x, bbox=code_block_6.width, y=code_block_6.y) { x-0.5*bbox; x+0.5*bbox; y-0.5*bbox; y+0.5*bbox; }
toString_3 = Custom[Springs.Number.ToString](num=code_block_8.out0)
toString_4 = Custom[Springs.Number.ToString](num=code_block_8.out2)
toString_5 = Custom[Springs.Number.ToString](num=code_block_8.out1)
toString_6 = Custom[Springs.Number.ToString](num=code_block_8.out3)
code_block_9 = CodeBlock { " -odir "; " -o "; }
string_2 = StringInput("\"")
concat_2 = String.Concat(downloadLASZIP.Laszip, code_block_3, code_block_4.out1, string, filepath_laz_pointcloud, string, code_block_5.out0, toString, code_block_5.out1, toString_2, code_block_7.out0, toString_3, code_block_7.out1, toString_4, code_block_7.out1, toString_5, code_block_7.out1, toString_6, code_block_9.out0, string, directory_laszip, string, code_block_9.out1, string_2, new_filename, string_2)
writeToFile = CSV.WriteToFile(concat, concat_2)

createBoundingBox = Custom[GIS2BIM.CreateBoundingBox](CoordinateX=getLocationdataNetherlands.RDcoordinateX_meters_double, CoordinateY=getLocationdataNetherlands.RDcoordinateY_meters_double, BoxWidth=boundingbox, BoxHeight=boundingbox)  # create boundingboxstring for webrequests based on coördinates and dimensions
geoservicesLibraryNetherlands = Custom[GIS2BIM.GeoservicesLibraryNetherlands](BoundingBox=createBoundingBox.Boxstring)  # Library with multiple webadresses which can be used for WFS and WMS webrequests
webrequestWMS2 = Custom[GIS2BIM.WebrequestWMS2](WMSwebrequest=geoservicesLibraryNetherlands.5_luchtfoto_2016_OGC_WMS)  # a webrequest based on WMS-protocol
watch_image = WatchImageCore(webrequestWMS2)
downloadAHN = Custom[GIS2BIM.DownloadAHN](UrlwebrequestAHN2=geoservicesLibraryNetherlands.11_AHN2_webrequest_bladindex_OGC_WFS, UrlwebrequestAHN3=geoservicesLibraryNetherlands.AHN3_webrequest_bladindex_OGC_WFS)  # get the mapnumber(s) of the AHN based on a given boundingbox
openBrowser = Custom[GIS2BIM.OpenBrowser](url=downloadAHN.downloadlink_AHN3)  # frozen; Opens a new window in your default browser with the given url.
