# Dynamo graph 9 Location Analysis.dyn (Dynamo 1.3.3.4111)

code_block = CodeBlock { "Dordrecht"; "Lange geldersekade"; "2"; }
getLocationdataNetherlands = Custom[GIS2BIM.GetLocationdataNetherlands](City=code_block.out0, Streetname=code_block.out1, Housenumber=code_block.out2)  # Gives locationdata based on an adress in the Netherlands
setSharedCoordinate = Custom[GIS2BIM.SetSharedCoordinate](x=getLocationdataNetherlands.RDcoordinateX_meters_double, y=getLocationdataNetherlands.RDcoordinateY_meters_double)  # Set shared coordinate/project basepoint
code_block_2 = CodeBlock { Rdx; }  # frozen; unwired: Rdx
code_block_3 = CodeBlock { Rdy; }  # frozen; unwired: Rdy
code_block_4 = CodeBlock { 500; }
code_block_5 = CodeBlock(Boundingboxwidth=code_block_4) { Boundingboxwidth; }
code_block_6 = CodeBlock { "natura2000"; "bodemkaart50000"; "opentopo"; "2017_ortho25IR"; "ahn3_5m_dsm"; "geomorfologischekaart50000"; }

# group: NATURA2000
WMTSScaleSetNetherlands = Custom[GIS2BIM.WMTSScaleSetNetherlands]()  # gives resolution, scaledenominator and number of tiles
WMTSZoomLevelTileRow = Custom[GIS2BIM.WMTSZoomLevelTileRow](Resolution=WMTSScaleSetNetherlands.Resolutie_m_pixel, Rdx=code_block_2, Rdy=code_block_3)  # gives the tilerow and tilecolumn for the WMTS webrequest
pixelWidth = CodeBlock { 256; }
WMTSTileListFromBbox = Custom[GIS2BIM.WMTSTileListFromBbox](TileRow=WMTSZoomLevelTileRow.TileRow, TileColumn=WMTSZoomLevelTileRow.TileColumn, Resolution=WMTSScaleSetNetherlands.Resolutie_m_pixel, PixelWidth=pixelWidth, BboxWidthInMeters=code_block_5)  # gives list of tilerows and tilecolums
WMTSGeoservicesLibraryNetherlands = Custom[GIS2BIM.WMTSGeoservicesLibraryNetherlands](TileRows=WMTSTileListFromBbox.TileRows, TileColumns=WMTSTileListFromBbox.TileColumns, Zoomlevel=WMTSScaleSetNetherlands.Zoomlevel, Layer=code_block_6.out0)  # library with webrequests of WMTS-services in the Netherlands
boolean = BoolSelector(true)
TMS_WMTS_WebrequestAndCombineImages = Custom[GIS2BIM.TMS_WMTS_WebrequestAndCombineImages](URLlist=WMTSGeoservicesLibraryNetherlands, UniqueTileNumbersColumnX=WMTSTileListFromBbox.UniqueTileColumns, UniqueTileNumbersRowY=WMTSTileListFromBbox.UniqueTileRows, Pixels=pixelWidth, WMTSorTMS=boolean)  # Webrequest for list of WMTS or TMS/Google webrequests for tiles. Combines them to 1 image.

watch_image = WatchImageCore(TMS_WMTS_WebrequestAndCombineImages.Image)
code_block_7 = CodeBlock(X=code_block_5) { X*100; }

# group: Bodem
WMTSScaleSetNetherlands_2 = Custom[GIS2BIM.WMTSScaleSetNetherlands]()
WMTSZoomLevelTileRow_2 = Custom[GIS2BIM.WMTSZoomLevelTileRow](Resolution=WMTSScaleSetNetherlands_2.Resolutie_m_pixel, Rdx=code_block_2, Rdy=code_block_3)
pixelWidth_2 = CodeBlock { 256; }
WMTSTileListFromBbox_2 = Custom[GIS2BIM.WMTSTileListFromBbox](TileRow=WMTSZoomLevelTileRow_2.TileRow, TileColumn=WMTSZoomLevelTileRow_2.TileColumn, Resolution=WMTSScaleSetNetherlands_2.Resolutie_m_pixel, PixelWidth=pixelWidth_2, BboxWidthInMeters=code_block_7)
WMTSGeoservicesLibraryNetherlands_2 = Custom[GIS2BIM.WMTSGeoservicesLibraryNetherlands](TileRows=WMTSTileListFromBbox_2.TileRows, TileColumns=WMTSTileListFromBbox_2.TileColumns, Zoomlevel=WMTSScaleSetNetherlands_2.Zoomlevel, Layer=code_block_6.out1)
boolean_2 = BoolSelector(true)
TMS_WMTS_WebrequestAndCombineImages_2 = Custom[GIS2BIM.TMS_WMTS_WebrequestAndCombineImages](URLlist=WMTSGeoservicesLibraryNetherlands_2, UniqueTileNumbersColumnX=WMTSTileListFromBbox_2.UniqueTileColumns, UniqueTileNumbersRowY=WMTSTileListFromBbox_2.UniqueTileRows, Pixels=pixelWidth_2, WMTSorTMS=boolean_2)

watch_image_2 = WatchImageCore(TMS_WMTS_WebrequestAndCombineImages_2.Image)

# group: AHN
WMTSScaleSetNetherlands_3 = Custom[GIS2BIM.WMTSScaleSetNetherlands]()
WMTSZoomLevelTileRow_3 = Custom[GIS2BIM.WMTSZoomLevelTileRow](Resolution=WMTSScaleSetNetherlands_3.Resolutie_m_pixel, Rdx=code_block_2, Rdy=code_block_3)
pixelWidth_3 = CodeBlock { 256; }
WMTSTileListFromBbox_3 = Custom[GIS2BIM.WMTSTileListFromBbox](TileRow=WMTSZoomLevelTileRow_3.TileRow, TileColumn=WMTSZoomLevelTileRow_3.TileColumn, Resolution=WMTSScaleSetNetherlands_3.Resolutie_m_pixel, PixelWidth=pixelWidth_3, BboxWidthInMeters=code_block_5)
WMTSGeoservicesLibraryNetherlands_3 = Custom[GIS2BIM.WMTSGeoservicesLibraryNetherlands](TileRows=WMTSTileListFromBbox_3.TileRows, TileColumns=WMTSTileListFromBbox_3.TileColumns, Zoomlevel=WMTSScaleSetNetherlands_3.Zoomlevel, Layer=code_block_6.out5)
boolean_3 = BoolSelector(true)
TMS_WMTS_WebrequestAndCombineImages_3 = Custom[GIS2BIM.TMS_WMTS_WebrequestAndCombineImages](URLlist=WMTSGeoservicesLibraryNetherlands_3, UniqueTileNumbersColumnX=WMTSTileListFromBbox_3.UniqueTileColumns, UniqueTileNumbersRowY=WMTSTileListFromBbox_3.UniqueTileRows, Pixels=pixelWidth_3, WMTSorTMS=boolean_3)

watch_image_3 = WatchImageCore(TMS_WMTS_WebrequestAndCombineImages_3.Image)
views = Views("Project View")  # frozen
views_2 = Views()  # frozen
views_3 = Views("3 Aerialphoto 2016")  # frozen
createBoundingBox = Custom[GIS2BIM.CreateBoundingBox](CoordinateX=getLocationdataNetherlands.RDcoordinateX_meters_double, CoordinateY=getLocationdataNetherlands.RDcoordinateY_meters_double, BoxWidth=code_block_4, BoxHeight=code_block_4)  # create boundingboxstring for webrequests based on coördinates and dimensions
geoservicesLibraryNetherlands = Custom[GIS2BIM.GeoservicesLibraryNetherlands](BoundingBox=createBoundingBox.Boxstring)  # frozen; Library with multiple webadresses which can be used for WFS and WMS webrequests
code_block_8 = CodeBlock()
# ---------- code_block_8.designscript (11 lines) ----------
"C:/TEMP/1opentopo.jpg";
"C:/TEMP/2opentopo.jpg";
"C:/TEMP/3Aerial2016.jpg";
"C:/TEMP/4Cadastre.jpg";
"C:/TEMP/5Aerialphoto2017.jpg";
"C:/TEMP/6BGT.jpg";
"C:/TEMP/7AHN.jpg";
"C:/TEMP/8Bestemmingsplan.jpg";
"C:/TEMP/9CBSInkomen.jpg";
"C:/TEMP/10GeologicalMaps.jpg";
"C:/TEMP/11Natura2000.jpg";
# ----------------------------------------

# group: 3 Aerialphoto 2016
webrequestWMS2 = Custom[GIS2BIM.WebrequestWMS2](WMSwebrequest=geoservicesLibraryNetherlands.5_luchtfoto_2016_OGC_WMS)  # frozen; a webrequest based on WMS-protocol
watch_image_4 = WatchImageCore(webrequestWMS2)
systemDrawingBitmapToJPG = Custom[GIS2BIM.SystemDrawingBitmapToJPG](SystemDrawingBitmap=watch_image_4, FileName=code_block_8.out2)  # Save an System.Drawing.Bitmap object as a jpg-file
importImageInView = Custom[GIS2BIM.ImportImageInView](ImageWidthMeters=code_block_4, View=views_3, ImagePath=systemDrawingBitmapToJPG)  # Import rasterimage in view

views_4 = Views()  # frozen
views_5 = Views()  # frozen
views_6 = Views()  # frozen
views_7 = Views()  # frozen
views_8 = Views()  # frozen
views_9 = Views()  # frozen
code_block_9 = CodeBlock { 8; 10000; }
views_10 = Views("1 Opentopo 1/25000")  # frozen
code_block_10 = CodeBlock(Rdx=getLocationdataNetherlands.RDcoordinateX_meters_double, Rdy=getLocationdataNetherlands.RDcoordinateY_meters_double) { Rdx; Rdy; }

# group: 1 OPENTOPO HIGH ZOOMLEVEL
WMTSScaleSetNetherlands_4 = Custom[GIS2BIM.WMTSScaleSetNetherlands](Zoomlevel=code_block_9.out0)  # frozen
WMTSZoomLevelTileRow_4 = Custom[GIS2BIM.WMTSZoomLevelTileRow](Resolution=WMTSScaleSetNetherlands_4.Resolutie_m_pixel, Rdx=code_block_10.Rdx, Rdy=code_block_10.Rdy)
pixelWidth_4 = CodeBlock { 256; }
WMTSTileListFromBbox_4 = Custom[GIS2BIM.WMTSTileListFromBbox](TileRow=WMTSZoomLevelTileRow_4.TileRow, TileColumn=WMTSZoomLevelTileRow_4.TileColumn, Resolution=WMTSScaleSetNetherlands_4.Resolutie_m_pixel, PixelWidth=pixelWidth_4, BboxWidthInMeters=code_block_9.out1)
WMTSGeoservicesLibraryNetherlands_4 = Custom[GIS2BIM.WMTSGeoservicesLibraryNetherlands](TileRows=WMTSTileListFromBbox_4.TileRows, TileColumns=WMTSTileListFromBbox_4.TileColumns, Zoomlevel=WMTSScaleSetNetherlands_4.Zoomlevel, Layer=code_block_6.out2)
boolean_4 = BoolSelector(true)
TMS_WMTS_WebrequestAndCombineImages_4 = Custom[GIS2BIM.TMS_WMTS_WebrequestAndCombineImages](URLlist=WMTSGeoservicesLibraryNetherlands_4, UniqueTileNumbersColumnX=WMTSTileListFromBbox_4.UniqueTileColumns, UniqueTileNumbersRowY=WMTSTileListFromBbox_4.UniqueTileRows, Pixels=pixelWidth_4, WMTSorTMS=boolean_4)

watch_image_5 = WatchImageCore(TMS_WMTS_WebrequestAndCombineImages_4.Image)
systemDrawingBitmapToJPG_2 = Custom[GIS2BIM.SystemDrawingBitmapToJPG](SystemDrawingBitmap=watch_image_5, FileName=code_block_8.out0)
importImageInView_2 = Custom[GIS2BIM.ImportImageInView](ImageWidthMeters=code_block_9.out1, View=views_10, ImagePath=systemDrawingBitmapToJPG_2)
views_11 = Views("2 Opentopo")  # frozen

# group: 2 OPENTOPO
WMTSScaleSetNetherlands_5 = Custom[GIS2BIM.WMTSScaleSetNetherlands]()  # frozen
WMTSZoomLevelTileRow_5 = Custom[GIS2BIM.WMTSZoomLevelTileRow](Resolution=WMTSScaleSetNetherlands_5.Resolutie_m_pixel, Rdx=code_block_10.Rdx, Rdy=code_block_10.Rdy)
pixelWidth_5 = CodeBlock { 256; }
WMTSTileListFromBbox_5 = Custom[GIS2BIM.WMTSTileListFromBbox](TileRow=WMTSZoomLevelTileRow_5.TileRow, TileColumn=WMTSZoomLevelTileRow_5.TileColumn, Resolution=WMTSScaleSetNetherlands_5.Resolutie_m_pixel, PixelWidth=pixelWidth_5, BboxWidthInMeters=code_block_5)
WMTSGeoservicesLibraryNetherlands_5 = Custom[GIS2BIM.WMTSGeoservicesLibraryNetherlands](TileRows=WMTSTileListFromBbox_5.TileRows, TileColumns=WMTSTileListFromBbox_5.TileColumns, Zoomlevel=WMTSScaleSetNetherlands_5.Zoomlevel, Layer=code_block_6.out2)
boolean_5 = BoolSelector(true)
TMS_WMTS_WebrequestAndCombineImages_5 = Custom[GIS2BIM.TMS_WMTS_WebrequestAndCombineImages](URLlist=WMTSGeoservicesLibraryNetherlands_5, UniqueTileNumbersColumnX=WMTSTileListFromBbox_5.UniqueTileColumns, UniqueTileNumbersRowY=WMTSTileListFromBbox_5.UniqueTileRows, Pixels=pixelWidth_5, WMTSorTMS=boolean_5)

watch_image_6 = WatchImageCore(TMS_WMTS_WebrequestAndCombineImages_5.Image)
systemDrawingBitmapToJPG_3 = Custom[GIS2BIM.SystemDrawingBitmapToJPG](SystemDrawingBitmap=watch_image_6, FileName=code_block_8.out1)
importImageInView_3 = Custom[GIS2BIM.ImportImageInView](ImageWidthMeters=code_block_5, View=views_11, ImagePath=systemDrawingBitmapToJPG_3)
views_12 = Views("5 Aerialphoto 2017")  # frozen

# group: 5 Aerialphoto 2017
webrequestWMS2_2 = Custom[GIS2BIM.WebrequestWMS2](WMSwebrequest=geoservicesLibraryNetherlands.Luchtfoto_2017_OGC_WMS)
watch_image_7 = WatchImageCore(webrequestWMS2_2)
systemDrawingBitmapToJPG_4 = Custom[GIS2BIM.SystemDrawingBitmapToJPG](SystemDrawingBitmap=watch_image_7, FileName=code_block_8.out4)
importImageInView_4 = Custom[GIS2BIM.ImportImageInView](ImageWidthMeters=code_block_4, View=views_12, ImagePath=systemDrawingBitmapToJPG_4)

views_13 = Views("8 Bestemmingsplan")

# group: 8 Bestemmingsplan
webrequestWMS2_3 = Custom[GIS2BIM.WebrequestWMS2](WMSwebrequest=geoservicesLibraryNetherlands.12_ruimtelijkeplannen_OGC_WMS)
watch_image_8 = WatchImageCore(webrequestWMS2_3)
systemDrawingBitmapToJPG_5 = Custom[GIS2BIM.SystemDrawingBitmapToJPG](SystemDrawingBitmap=watch_image_8, FileName=code_block_8.out7)
importImageInView_5 = Custom[GIS2BIM.ImportImageInView](ImageWidthMeters=code_block_4, View=views_13, ImagePath=systemDrawingBitmapToJPG_5)

views_14 = Views("7 AHN")

# group: 7 AHN
WMTSScaleSetNetherlands_6 = Custom[GIS2BIM.WMTSScaleSetNetherlands]()
WMTSZoomLevelTileRow_6 = Custom[GIS2BIM.WMTSZoomLevelTileRow](Resolution=WMTSScaleSetNetherlands_6.Resolutie_m_pixel, Rdx=code_block_10.Rdx, Rdy=code_block_10.Rdy)
pixelWidth_6 = CodeBlock { 256; }
WMTSTileListFromBbox_6 = Custom[GIS2BIM.WMTSTileListFromBbox](TileRow=WMTSZoomLevelTileRow_6.TileRow, TileColumn=WMTSZoomLevelTileRow_6.TileColumn, Resolution=WMTSScaleSetNetherlands_6.Resolutie_m_pixel, PixelWidth=pixelWidth_6, BboxWidthInMeters=code_block_5)
WMTSGeoservicesLibraryNetherlands_6 = Custom[GIS2BIM.WMTSGeoservicesLibraryNetherlands](TileRows=WMTSTileListFromBbox_6.TileRows, TileColumns=WMTSTileListFromBbox_6.TileColumns, Zoomlevel=WMTSScaleSetNetherlands_6.Zoomlevel, Layer=code_block_6.out4)
boolean_6 = BoolSelector(true)
TMS_WMTS_WebrequestAndCombineImages_6 = Custom[GIS2BIM.TMS_WMTS_WebrequestAndCombineImages](URLlist=WMTSGeoservicesLibraryNetherlands_6, UniqueTileNumbersColumnX=WMTSTileListFromBbox_6.UniqueTileColumns, UniqueTileNumbersRowY=WMTSTileListFromBbox_6.UniqueTileRows, Pixels=pixelWidth_6, WMTSorTMS=boolean_6)

watch_image_9 = WatchImageCore(TMS_WMTS_WebrequestAndCombineImages_6.Image)  # frozen
systemDrawingBitmapToJPG_6 = Custom[GIS2BIM.SystemDrawingBitmapToJPG](SystemDrawingBitmap=watch_image_9, FileName=code_block_8.out6)
importImageInView_6 = Custom[GIS2BIM.ImportImageInView](ImageWidthMeters=code_block_5, View=views_14, ImagePath=systemDrawingBitmapToJPG_6)
