# Dynamo graph 9.11 WMS Natura2000.dyn (Dynamo 1.3.3.4111)

code_block = CodeBlock { "Dordrecht"; "Lange geldersekade"; "2"; }
getLocationdataNetherlands = Custom[GIS2BIM.GetLocationdataNetherlands](City=code_block.out0, Streetname=code_block.out1, Housenumber=code_block.out2)  # Gives locationdata based on an adress in the Netherlands
setSharedCoordinate = Custom[GIS2BIM.SetSharedCoordinate](x=getLocationdataNetherlands.RDcoordinateX_meters_double, y=getLocationdataNetherlands.RDcoordinateY_meters_double)  # Set shared coordinate/project basepoint
link_kadaster = CodeBlock()
# ---------- link_kadaster.designscript (11 lines) ----------
"http://geodata.nationaalgeoregister.nl/";
"geomorfologischekaart50000/wms?";
"&request=GetMap";
"&VERSION=1.3.0";
"&STYLES=geomorfologischekaart50000";
"&layers=geomorfologischekaart50000";
"&bbox=";
"&width=3000";
"&height=3000";
"&format=image/png";
"&crs=EPSG:28992";
# ----------------------------------------
code_block_2 = CodeBlock { 50000; }
createBoundingBox = Custom[GIS2BIM.CreateBoundingBox](CoordinateX=getLocationdataNetherlands.RDcoordinateX_meters_double, CoordinateY=getLocationdataNetherlands.RDcoordinateY_meters_double, BoxWidth=code_block_2, BoxHeight=code_block_2)  # create boundingboxstring for webrequests based on coördinates and dimensions
concat = String.Concat(link_kadaster.out0, link_kadaster.out1, link_kadaster.out2, link_kadaster.out3, link_kadaster.out4, link_kadaster.out5, link_kadaster.out6, createBoundingBox.Boxstring, link_kadaster.out7, link_kadaster.out8, link_kadaster.out9, link_kadaster.out10)
webrequestWMS2 = Custom[GIS2BIM.WebrequestWMS2](WMSwebrequest=concat)  # a webrequest based on WMS-protocol
watch_image = WatchImageCore(webrequestWMS2)
views = Views("10 Geological Maps")
code_block_3 = CodeBlock { "C:/TEMP/10GeologicalMaps.jpg"; "C:/TEMP/11Natura2000.jpg"; }
systemDrawingBitmapToJPG = Custom[GIS2BIM.SystemDrawingBitmapToJPG](SystemDrawingBitmap=webrequestWMS2, FileName=code_block_3.out0)  # Save an System.Drawing.Bitmap object as a jpg-file
importImageInView = Custom[GIS2BIM.ImportImageInView](ImageWidthMeters=code_block_2, View=views, ImagePath=systemDrawingBitmapToJPG)  # Import rasterimage in view
