# Dynamo graph 9.12 Building Year of Construction.dyn (Dynamo 1.3.3.4111)

code_block = CodeBlock { "Dordrecht"; "Lange geldersekade"; "2"; }
getLocationdataNetherlands = Custom[GIS2BIM.GetLocationdataNetherlands](City=code_block.out0, Streetname=code_block.out1, Housenumber=code_block.out2)  # Gives locationdata based on an adress in the Netherlands
code_block_2 = CodeBlock { 500; }
createBoundingBox = Custom[GIS2BIM.CreateBoundingBox](CoordinateX=getLocationdataNetherlands.RDcoordinateX_meters_double, CoordinateY=getLocationdataNetherlands.RDcoordinateY_meters_double, BoxWidth=code_block_2, BoxHeight=code_block_2)  # create boundingboxstring for webrequests based on coördinates and dimensions
geoservicesLibraryNetherlands = Custom[GIS2BIM.GeoservicesLibraryNetherlands](BoundingBox=createBoundingBox.Boxstring)  # Library with multiple webadresses which can be used for WFS and WMS webrequests
web_request = WebRequest(geoservicesLibraryNetherlands.4_bag_pand_OGC_WFS)
string = StringInput(".//{http://bag.geonovum.nl}bouwjaar")
create = List.Create(string)
XMLXPath = Custom[GIS2BIM.XMLXPath](XMLString=web_request, XPathStrings=create)  # Run an XPathquery on an xml-string
flatten = Flatten(XMLXPath)
toNumber = String.ToNumber(flatten)
views = Views("12 BuildingAge")
createPointsPolygonFromGMLxyz = Custom[GIS2BIM.CreatePointsPolygonFromGMLxyz](XML=web_request, DeltaX=getLocationdataNetherlands.RDcoordinateX_meters_double, DeltaY=getLocationdataNetherlands.RDcoordinateY_meters_double)  # Create points and polygons from a xml/gml-file with x,y and z value
flatten_2 = Flatten(createPointsPolygonFromGMLxyz.PolyCurves)
explode = Geometry.Explode(flatten_2)
select_filled_region_type = FilledRegionTypes("FP_DP_90_pand")
byCurves = FilledRegion.ByCurves(views, explode, select_filled_region_type)
minimumItem = List.MinimumItem(toNumber)
maximumItem = List.MaximumItem(toNumber)

# group: OVERRIDE COLOR IN VIEW
code_block_3 = CodeBlock(b=toNumber) { dy=a-b; }  # unwired: a
fill_patterns = FillPatterns("&lt;Solid fill&gt;")
code_block_4 = CodeBlock(x=toNumber, min=minimumItem, max=maximumItem) { dx=x-min; dxx=max-min; dxnormalised=dx/dxx; Rvalue=dxnormalised*255; transp=dxnormalised*100; }
to_int = Custom[To Int](listIn=code_block_4.Rvalue)
code_block_5 = CodeBlock { 235; 17; 27; }
byARGB = Color.ByARGB(r=to_int, g=code_block_5.out1, b=code_block_5.out2)
to_int_2 = Custom[To Int](listIn=code_block_4.transp)
byProperties = Revit.Filter.OverrideGraphicSettings.ByProperties(arg3=byARGB, arg10=to_int_2)
overrideInView = Element.OverrideInView(element=byCurves, overrides=byProperties)
