# Dynamo graph 9.4 Dutch Cadastre 2D.dyn (Dynamo 1.3.1.1736)

code_block = CodeBlock { 1000; }
getSharedCoordinate = Custom[GIS2BIM.GetSharedCoordinate](scale=code_block)  # Get the current shared coordinate
current = Document.Current()
activeView = Document.ActiveView(current)

# group: INPUT
code_block_2 = CodeBlock { "2.5 mm"; "3.5 mm"; "2.5 mm"; }
boundingboxwidth_m = CodeBlock { 250; }
lineStyleKadaster = CodeBlock { "_0.25 mm CENTER"; }
lineStyleBAGPand = StringInput("pen rood")

# group: GET GEOSERVICES
createBoundingBox = Custom[GIS2BIM.CreateBoundingBox](CoordinateX=getSharedCoordinate.E_W, CoordinateY=getSharedCoordinate.N_S, BoxWidth=boundingboxwidth_m, BoxHeight=boundingboxwidth_m)  # create boundingboxstring for webrequests based on coördinates and dimensions
geoservicesLibraryNetherlands = Custom[GIS2BIM.GeoservicesLibraryNetherlands](BoundingBox=createBoundingBox.Boxstring)  # Library with multiple webadresses which can be used for WFS and WMS webrequests

# group: KADASTER ANNOTATION
kadasterPercelen = Custom[GIS2BIM.KadasterPercelen](DeltaX=getSharedCoordinate.E_W, DeltaY=getSharedCoordinate.N_S, View=activeView, TextTypePerceel=code_block_2.out2, UrlWebrequestKadasterPerceel=geoservicesLibraryNetherlands.8_kadastrale_perceel)  # Draw propertylines and place streetnames and housenumbers from the dutch kadaster
kadasterHouseNumbers = Custom[GIS2BIM.KadasterHouseNumbers](UrlWebrequestKadasterAnnotation=geoservicesLibraryNetherlands.7_kadastrale_annotatie, DeltaX=getSharedCoordinate.E_W, DeltaY=getSharedCoordinate.N_S, View=activeView, TextTypeHousenumber=code_block_2.out0, TextTypeStreetname=code_block_2.out1)

code_block_3 = CodeBlock { 1000; }

# group: KADASTRALE PERCELEN(GRENZEN)
web_request = WebRequest(geoservicesLibraryNetherlands.8_kadastrale_perceel)
code_block_4 = CodeBlock { ".//{http://www.opengis.net/gml/3.2}posList"; }
createPointsPolygonFromGMLxy = Custom[GIS2BIM.CreatePointsPolygonFromGMLxy](XML=web_request, XPATHSTRING=code_block_4, DeltaX=getSharedCoordinate.E_W, DeltaY=getSharedCoordinate.N_S, UnitsConversionFactor=code_block_3)  # Create point and polygons from a GML-file
createDetailLinesFromPolygons = Custom[GIS2BIM.CreateDetailLinesFromPolygons](View=activeView, PolyCurves=createPointsPolygonFromGMLxy.PolyCurves, Linestyle=lineStyleKadaster)  # Create detaillines from polygons in a view

filledregiontypebag_pand = FilledRegionTypes("00 BETON TPG")

# group: BAG: pand
web_request_2 = WebRequest(geoservicesLibraryNetherlands.4_bag_pand_WFS)
boolean = BoolSelector(true)
createPointsPolygonFromGMLxyz = Custom[GIS2BIM.CreatePointsPolygonFromGMLxyz](XML=web_request_2, XPATHSTRING=code_block_4, DeltaX=getSharedCoordinate.E_W, DeltaY=getSharedCoordinate.N_S, Connectpolygon=boolean)  # Create points and polygons from a xml/gml-file with x,y and z value
createDetailLinesFromPolygons_2 = Custom[GIS2BIM.CreateDetailLinesFromPolygons](View=activeView, PolyCurves=createPointsPolygonFromGMLxyz.PolyCurves, Linestyle=lineStyleBAGPand)
explode = Geometry.Explode(createPointsPolygonFromGMLxyz.PolyCurves)
byCurves = FilledRegion.ByCurves(activeView, explode, filledregiontypebag_pand)
