# Dynamo graph 9.6 BGT.dyn (Dynamo 1.3.3.4111)

code_block = CodeBlock { 1000; }
getSharedCoordinate = Custom[GIS2BIM.GetSharedCoordinate](scale=code_block)  # Get the current shared coordinate
getMortonCodeCoordinate = Custom[GIS2BIM.GetMortonCodeCoordinate](X=getSharedCoordinate.E_W, Y=getSharedCoordinate.N_S)  # Get mortoncode given 2 coordinates and tiledimension
# note: It will take quite some time to run this node. It can take 10 minutes. When you run parts of it it will be quicker. Open the file: GIStoBIM1.rvt from the package-folder to use the standard filled regions and linetypes.
TEMPfolder = StringInput("C:\TEMP")
downloadBGTdata = Custom[GIS2BIM.DownloadBGTdata](Mortoncode=getMortonCodeCoordinate, Directory=TEMPfolder)  # Download BGT-data(dutch GIS-information)
unzipFile = Custom[GIS2BIM.UnzipFile](FilePathZipFile=downloadBGTdata.Location, DirectoryToExtractTo=downloadBGTdata.Directory)  # Unzip zip-file
width = CodeBlock { 500; }
code_block_2 = CodeBlock { Revit.Application.Document.Current.ActiveView; }

# group: 2D SETTINGS
# note: Panden;
# 0 bgt_overigbouwwerk;
# Groen;
# 1 bgt_begroeidterreindeel;
# Lijnen(aparte lagen);
# 2 bgt_functioneelgebied;
# 3 bgt_gebouwinstallatie;
# 4 bgt_kunstwerkdeel;
# 5 bgt_onbegroeidterreindeel;
# 6 bgt_ondersteunendwegdeel;
# 7 bgt_overigescheiding;
# 8 bgt_scheiding;
# 9 bgt_spoor;
# 10 bgt_tunneldeel;
# Wegen bruggen en kunstwerken;
# 11 bgt_kunstwerkdeel;
# 12 bgt_overbruggingsdeel;
# 13 bgt_wegdeel;
# Water;
# 14 bgt_ondersteunendwaterdeel;
# 15 bgt_waterdeel;
# Labels;
# 16 bgt_openbareruimtelabel;
# Puntobject;
# 17 bgt_vegetatieobject;
tree = FamilyTypes("90_DI_boom:90_DI_boom")
PANDEN = FilledRegionTypes("FP_DP_90_pand")
GROEN1 = FilledRegionTypes("FP_DP_90_groen1")
GROEN2 = FilledRegionTypes("FP_DP_90_groen2")
WEG = FilledRegionTypes("FP_DP_90_weg")
weg_ondergeschikt = FilledRegionTypes("FP_DP_90_weg2")
WATER = FilledRegionTypes("FP_DP_90_water")
line_styles = CodeBlock()
# ---------- line_styles.designscript (9 lines) ----------
"bgt_functioneelgebied";
"bgt_gebouwinstallatie";
"bgt_kunstwerkdeel";
"bgt_onbegroeidterreindeel";
"bgt_ondersteunendwegdeel";
"bgt_overigescheiding";
"bgt_scheiding";
"bgt_spoor";
"bgt_tunneldeel";
# ----------------------------------------

BGT2D = Custom[GIS2BIM.BGT2D](Directory=downloadBGTdata.Directory, RDx=getSharedCoordinate.E_W, RDy=getSharedCoordinate.N_S, BoundingboxWidth=width, View=code_block_2, DetailcomponentTree=tree, FilledRegionPand=PANDEN, FilledRegionGreen1=GROEN1, FilledRegionGreen2=GROEN2, FilledRegionRoad=WEG, FilledRegionRoad2=weg_ondergeschikt, FilledRegionWater=WATER, LineStyleBGT_functioneelgebied=line_styles.out0, LineStyleBGT_gebouwinstallatie=line_styles.out1, LineStyleBGT_kunstwerkdeel=line_styles.out2, LineStyleBGT_onbegroeidterreindeel=line_styles.out3, LineStyleBGT_ondersteunendwegdeel=line_styles.out4, LineStyleBGT_overigescheiding=line_styles.out5, LineStyleBGT_scheiding=line_styles.out6, LineStyleBGT_spoor=line_styles.out7, LineStyleBGT_tunneldeel=line_styles.out8)  # Create 2D BGT siteplan from set of GML-files
