# Dynamo graph 9.9 CBS.dyn (Dynamo 1.3.3.4111)

code_block = CodeBlock { "Dordrecht"; "Lange geldersekade"; "2"; }
getLocationdataNetherlands = Custom[GIS2BIM.GetLocationdataNetherlands](City=code_block.out0, Streetname=code_block.out1, Housenumber=code_block.out2)  # Gives locationdata based on an adress in the Netherlands
setSharedCoordinate = Custom[GIS2BIM.SetSharedCoordinate](x=getLocationdataNetherlands.RDcoordinateX_meters_double, y=getLocationdataNetherlands.RDcoordinateY_meters_double)  # Set shared coordinate/project basepoint
code_block_2 = CodeBlock { 500; }
createBoundingBox = Custom[GIS2BIM.CreateBoundingBox](CoordinateX=getLocationdataNetherlands.RDcoordinateX_meters_double, CoordinateY=getLocationdataNetherlands.RDcoordinateY_meters_double, BoxWidth=code_block_2, BoxHeight=code_block_2)  # create boundingboxstring for webrequests based on coördinates and dimensions
geoservicesLibraryNetherlands = Custom[GIS2BIM.GeoservicesLibraryNetherlands](BoundingBox=createBoundingBox.Boxstring)  # Library with multiple webadresses which can be used for WFS and WMS webrequests
webrequestWMS2 = Custom[GIS2BIM.WebrequestWMS2](WMSwebrequest=geoservicesLibraryNetherlands.6_legenda)  # a webrequest based on WMS-protocol
watch_image = WatchImageCore(webrequestWMS2)
views = Views("9 CBS Inkomen")
webrequestWMS2_2 = Custom[GIS2BIM.WebrequestWMS2](WMSwebrequest=geoservicesLibraryNetherlands.6_CBS_WOZ_2011_100m_OGC_WMS)  # frozen
code_block_3 = CodeBlock()
# ---------- code_block_3.designscript (12 lines) ----------
"C:/TEMP/1opentopo.jpg";
"C:/TEMP/2opentopo.jpg";
"C:/TEMP/3Aerial2016.jpg";
"C:/TEMP/4Cadastre.jpg";
"C:/TEMP/5Aerialphoto2017.jpg";
"C:/TEMP/6BGT.jpg";
"C:/TEMP/7AHN.jpg";
"C:/TEMP/8Bestemmingsplan.jpg";
"C:/TEMP/9CBSInkomen.jpg";
"C:/TEMP/9CBSInkomenLegend.jpg";
"C:/TEMP/10GeologicalMaps.jpg";
"C:/TEMP/11Natura2000.jpg";
# ----------------------------------------
systemDrawingBitmapToJPG = Custom[GIS2BIM.SystemDrawingBitmapToJPG](SystemDrawingBitmap=webrequestWMS2_2, FileName=code_block_3.out8)  # frozen; Save an System.Drawing.Bitmap object as a jpg-file
importImageInView = Custom[GIS2BIM.ImportImageInView](ImageWidthMeters=code_block_2, View=views, ImagePath=systemDrawingBitmapToJPG)  # Import rasterimage in view
systemDrawingBitmapToJPG_2 = Custom[GIS2BIM.SystemDrawingBitmapToJPG](SystemDrawingBitmap=webrequestWMS2, FileName=code_block_3.out9)
importImageInView_2 = Custom[GIS2BIM.ImportImageInView](ImageWidthMeters=code_block_2, View=views, ImagePath=systemDrawingBitmapToJPG_2)
