# Dynamo graph D_Assembly sheets als template.dyn (Dynamo 1.3.3.4651)

# group: CHOOSE FILTER
code_block = CodeBlock { "TODO"; }

# group: SELECT ASSEMBLIES
categories = Categories("Assemblies")
all_elements_of_category = ElementsOfCategory(categories)
code_block_2 = CodeBlock { "Comments"; }
getParameterValueByName = Element.GetParameterValueByName(element=all_elements_of_category, parameterName=code_block_2)
equals = Equals(getParameterValueByName, code_block)
filterByBoolMask = List.FilterByBoolMask(list=all_elements_of_category, mask=equals)

name = Element.Name(filterByBoolMask.in)
groupByKey = List.GroupByKey(list=filterByBoolMask.in, keys=name)
firstItem = List.FirstItem(groupByKey.groups@L2)

# group: CHOOSE SHEET
family_types = FamilyTypes("A4_A0_grootformaat:A2")

# group: CHOOSE TEMPLATE
categories_2 = Categories("Sheets")
all_elements_of_category_2 = ElementsOfCategory(categories_2)
code_block_3 = CodeBlock(lijst=all_elements_of_category_2) { lijst[5]; }
name_2 = Element.Name(all_elements_of_category_2)

# group: Extract sheet template views
views = Custom[Springs.Sheet.Views+](sheet=code_block_3)  # Extracts all views and schedules (minus the revision schedule) placed on the input sheet (or sheets). Will be depreciated once the bult in node works with all plan types.
flatten = Flatten(views.view_s)
name_3 = Element.Name(flatten)
code_block_4 = CodeBlock()
# ---------- code_block_4.designscript (13 lines) ----------
"Elevation Right";
"Elevation Front";
"Elevation Back";
"Elevation Left";
"Elevation Bottom";
"Detail Section A";
"Detail Section B";
"Part List";
"Elevation Top";
"Plan Detail";
"3D Ortho";
"Assembly List";
"3D Ortho 2";
# ----------------------------------------
create = List.Create(code_block_4.out0, code_block_4.out1, code_block_4.out2, code_block_4.out3, code_block_4.out4, code_block_4.out5, code_block_4.out6, code_block_4.out7, code_block_4.out8, code_block_4.out9, code_block_4.out10, code_block_4.out11, code_block_4.out12)
containsItem = List.ContainsItem(list=name_3, item=create)

# group: - Create assembly views based on template sheet
# note: Nu geen mogelijkheid een Generic Model + Material take off schedules aan te maken
boolean = BoolSelector(true)
code_block_5 = CodeBlock(lijst=containsItem)
# ---------- code_block_5.designscript (13 lines) ----------
lijst[0];
lijst[1];
lijst[2];
lijst[3];
lijst[4];
lijst[5];
lijst[6];
lijst[7];
lijst[8];
lijst[9];
lijst[10];
lijst[11];
lijst[12];
# ----------------------------------------
assemblyViews = Custom[Tool.AssemblyViews](Assembly_List=firstItem, TitleBlockType=family_types, CreateSheet=boolean, ElevationRight=code_block_5.out0, ElevationFront=code_block_5.out1, ElevationBack=code_block_5.out2, PartList=code_block_5.out7, ElevationLeft=code_block_5.out3, ElevationTop=code_block_5.out8, ElevationBottom=code_block_5.out4, Ortho3D=code_block_5.out10, PlanView=code_block_5.out9, DetailSectionA=code_block_5.out5, DetailSectionB=code_block_5.out6)  # Create Sheet and Views for Assembly instances

# group: Filter legend out
type = Custom[View.Type](view=flatten)  # Returns the type of a given view
code_block_6 = CodeBlock { "Legend"; }
equals_2 = Equals(type, code_block_6)
filterByBoolMask_2 = List.FilterByBoolMask(list=flatten, mask=equals_2)

viewTemplate = Custom[View.ViewTemplate](view=filterByBoolMask_2.out)  # Returns the view template assigned to a given view (if one is assigned)
sort = List.Sort(viewTemplate)

# group: Get view templates from sheet template and apply on new views
watch = Watch(assemblyViews.List_of_View_s)
transpose = List.Transpose(watch)
code_block_7 = CodeBlock { "View Template"; }

sort_2 = List.Sort(transpose)

# group (continued): Get view templates from sheet template and apply on new views
setParameterByName = Element.SetParameterByName(element=sort_2, parameterName=code_block_7, value=sort)

# group: Find legend
name_4 = Element.Name(filterByBoolMask_2.in)
view_type = ViewTypesUi("Legend")
getByType = archilab.Revit.Views.Views.GetByType(view_type)
name_5 = Element.Name(getByType)
equals_3 = Equals(name_5, name_4, lacing=Longest)
filterByBoolMask_3 = List.FilterByBoolMask(list=getByType, mask=equals_3)
firstItem_2 = List.FirstItem(filterByBoolMask_3.in)

# group: Find template viewport boxcenter
viewports = archilab.Revit.Views.Sheets.Viewports(code_block_3)
code_block_8 = CodeBlock { "View Name"; }
getParameterValueByName_2 = Element.GetParameterValueByName(element=viewports, parameterName=code_block_8)
eq = getParameterValueByName_2 == name_4  # lacing=Longest
filterByBoolMask_4 = List.FilterByBoolMask(list=viewports, mask=eq)
viewPortBoxCenter = Custom[View.ViewPortBoxCenter](Viewports=filterByBoolMask_4.in)  # Get ViewPort Box center point

# group: Place legends
count = List.Count(assemblyViews.Sheet_s)
cycle = List.Cycle(list=viewPortBoxCenter, amount=count)
flatten_2 = Flatten(assemblyViews.Sheet_s)
number_slider = DoubleSlider(0.5, range=0..3 step 0.001)
number_slider_2 = DoubleSlider(0.75, range=0..2.28 step 0.001)
byCoordinates = Point.ByCoordinates(x=number_slider, y=number_slider_2)
place_legend_on_sheets_py = Python(IN[0]=firstItem_2, IN[1]=flatten_2, IN[2]=byCoordinates)
# ---------- place_legend_on_sheets_py.python (40 lines) ----------
import clr
# import Document Manager
clr.AddReference("RevitServices")
import RevitServices 
from RevitServices.Persistence import DocumentManager
from RevitServices.Transactions import TransactionManager
doc = DocumentManager.Instance.CurrentDBDocument
uidoc = DocumentManager.Instance.CurrentUIDocument
clr.AddReference("RevitNodes")
import Revit
clr.ImportExtensions(Revit.Elements)
clr.ImportExtensions(Revit.GeometryConversion)
clr.AddReference("RevitAPI")
from Autodesk.Revit.DB import *

dataEnteringNode = IN

legend = UnwrapElement(IN[0])
sheets = IN[1]
loc = XYZ(IN[2].X, IN[2].Y, IN[2].Z)
viewports = []
failed = []

for vs in sheets:
	sheet = UnwrapElement(vs)
	canAddToSht = Viewport.CanAddViewToSheet(doc, sheet.Id, legend.Id)
	if canAddToSht:
		try:		
			TransactionManager.Instance.EnsureInTransaction(doc)	
			viewport = Viewport.Create(doc, sheet.Id, legend.Id, loc)	
			TransactionManager.Instance.TransactionTaskDone()
			viewports.Add([viewport,sheet])
		except:
			failed.Add(["Failed",sheet])
	else:
		failed.Add(["Failed",sheet])
		
OUT = viewports
	
#For more information refer to RBG Wiki or email me (ctrl + click link): daniel.woodcock@robertbird.com
# ----------------------------------------
firstItem_3 = List.FirstItem(place_legend_on_sheets_py, lacing=Longest)
setBoxCenter = Custom[Viewport.SetBoxCenter](Points=cycle, Viewport_list=firstItem_3)  # API class

# group: set viewport type
viewports_2 = archilab.Revit.Views.Sheets.Viewports(assemblyViews.Sheet_s)
flatten_3 = Flatten(viewports_2)
get_all_viewport_types = Custom[Get All Viewport Types]()  # This node will retrieve all Viewport Types currently in the model.
name_6 = Parameter.Name(get_all_viewport_types)
code_block_9 = CodeBlock { "1. Geen"; }
eq_2 = name_6 == code_block_9

name_7 = Element.Name(get_all_viewport_types)

# group (continued): set viewport type
filterByBoolMask_5 = List.FilterByBoolMask(list=name_7, mask=eq_2)
firstItem_4 = List.FirstItem(filterByBoolMask_5.in)
python_script = Python(IN[0]=flatten_3, IN[1]=firstItem_4)
# ---------- python_script.python (35 lines) ----------
import clr
# Import Element wrapper extension methods
clr.AddReference("RevitNodes")
import Revit
clr.ImportExtensions(Revit.Elements)

# Import DocumentManager and TransactionManager
clr.AddReference("RevitServices")
import RevitServices
from RevitServices.Persistence import DocumentManager
from RevitServices.Transactions import TransactionManager
doc = DocumentManager.Instance.CurrentDBDocument

import sys
pyt_path = r'C:\Program Files (x86)\IronPython 2.7\Lib'
sys.path.append(pyt_path)

# Import RevitAPI
clr.AddReference("RevitAPI")
import Autodesk
from Autodesk.Revit.DB import *

#The inputs to this node will be stored as a list in the IN variable.

viewPort=UnwrapElement(IN[0])
newId=UnwrapElement(IN[1])

TransactionManager.Instance.EnsureInTransaction(doc)

for i in viewPort:
	i.ChangeTypeId(ElementId(newId))
TransactionManager.Instance.TransactionTaskDone()

#Assign your output to the OUT variable
OUT = newId
# ----------------------------------------

# group: Rename SheetName and SheetNumber as Assembly name
element_types = ElementTypes("ViewSheet")
all_elements_of_type = ElementsOfType(element_types)
code_block_10 = CodeBlock { "Assembly: Name"; }
getParameterValueByName_3 = Element.GetParameterValueByName(element=all_elements_of_type, parameterName=code_block_10)
length = String.Length(getParameterValueByName_3)
code_block_11 = CodeBlock { 0; }
gt = length > code_block_11
filterByBoolMask_6 = List.FilterByBoolMask(list=all_elements_of_type, mask=gt)
code_block_12 = CodeBlock { "Sheet Name"; "Sheet Number"; }
filterByBoolMask_7 = List.FilterByBoolMask(list=getParameterValueByName_3, mask=gt)
setParameterByName_2 = Element.SetParameterByName(element=filterByBoolMask_6.in, parameterName=code_block_12.out1, value=filterByBoolMask_7.in)
setParameterByName_3 = Element.SetParameterByName(element=filterByBoolMask_6.in, parameterName=code_block_12.out0, value=filterByBoolMask_7.in)

code_block_13 = CodeBlock()  # //NU WORDEN DE VIEWPORTS VAN LEGENDS NOG NIET MEEGENOMEN
string = StringInput("ELEM_TYPE_PARAM")
set_builtin_parameter = Custom[Set BuiltIn Parameter](ParameterName=string, Elements=flatten_3, ParameterValues=firstItem_4)  # This node will take an input of a built in parameter name and set that parameter to given value for given elements.
get_bipparameter_name = BuiltInParamSelector()
code_block_14 = CodeBlock { "ELEM_TYPE_PARAM"; }
firstItem_5 = List.FirstItem(viewports_2)
firstItem_6 = List.FirstItem(firstItem_5)
string_2 = StringInput("ELEMENT_TYPE_PARAMETER")
getBuiltInParamterName = archilab.Revit.Elements.Parameter.GetBuiltInParamterName(firstItem_6, string_2)
get_bipparameter_name_2 = BuiltInParamSelector()
get_built_in_parameter = Custom[Get Built In Parameter](ParameterNames=string, Elements=firstItem_6)  # This node will take an input of a built in parameter name and element to return that parameters value.
code_block_15 = CodeBlock()  # //https://forum.dynamobim.com/t/how-to-set-viewport-type/7200
code_block_16 = CodeBlock {  }
