# Dynamo graph G Assembly Views Allign.dyn (Dynamo 1.3.3.4651)

# group: UI Select sheet template
ui_dropdown_data = Custom[UI.DropDown Data]()  # Create data for DropDown input in UI.MultiInputForm ++ . Check out www.data-shapes.net for more infos.; unwired: Keys, Values
code_block = CodeBlock { "Select Template Sheet"; }
categories = Categories("Sheets")
all_elements_of_category = ElementsOfCategory(categories)
sheetNumber = Sheet.SheetNumber(all_elements_of_category)
sheetName = Sheet.SheetName(all_elements_of_category)
code_block_2 = CodeBlock(a=sheetNumber, b=sheetName) { a+ ""+b; }
ui_dropdown_data_2 = Custom[UI.DropDown Data](InputName=code_block, Keys=code_block_2, Values=all_elements_of_category)

# group: UI select assembly
code_block_3 = CodeBlock { "Select sheet to align"; }
categories_2 = Categories("Sheets")
all_elements_of_category_2 = ElementsOfCategory(categories_2)
sheetNumber_2 = Sheet.SheetNumber(all_elements_of_category_2)
sheetName_2 = Sheet.SheetName(all_elements_of_category_2)
code_block_4 = CodeBlock(a=sheetNumber_2, b=sheetName_2) { a+ ""+b; }
ui_listview_data = Custom[UI.Listview Data](InputName=code_block_3, Keys=code_block_4, Values=all_elements_of_category_2)  # Create data for ListView input in UI.MultiInputForm ++ . Check out www.data-shapes.net for more infos.
create = List.Create(ui_listview_data, ui_dropdown_data_2)
boolean = BoolSelector(true)
code_block_5 = CodeBlock { "Cancel2"; }
code_block_6 = CodeBlock { 501; }
ui_multipleinputform = Custom[UI.MultipleInputForm ++](Inputs=create, Toggle=boolean, CancelButtonText_optional=code_block_5, Width_optional=code_block_6)  # Create a form with multiple inputs. see www.data-shapes.net for tutorials and infos!

firstItem = List.FirstItem(ui_multipleinputform.User_Inputs)
code_block_7 = CodeBlock(Sheet=firstItem) { Sheet; }
code_block_8 = CodeBlock(a=code_block_7) { Flatten({a}); }

# group: Viewports from sheets and sort
getViewport = Custom[View.GetViewport](Sheet=code_block_8)  # Get Vieworts from Views
code_block_9 = CodeBlock { "View Name"; }
getParameterValueByName = Element.GetParameterValueByName(element=getViewport, parameterName=code_block_9)
python_script = Python(IN[0]=getParameterValueByName, IN[1]=getViewport)
# ---------- python_script.python (19 lines) ----------
import clr
clr.AddReference('ProtoGeometry')
from Autodesk.DesignScript.Geometry import *
#The inputs to this node will be stored as a list in the IN variables.

X = IN[0]
Y = IN[1]

Z1 = []
for i,j in zip(X,Y):
		Z1.append(sorted(zip(i,j)))
Z2 = []
for i in Z1:
	for j in i:
		Z2.append(j[1])
	

#Assign your output to the OUT variable.
OUT = Z2
# ----------------------------------------

viewPortBoxCenter = Custom[View.ViewPortBoxCenter](Viewports=python_script)  # Get ViewPort Box center point
viewport_min_max = Python(IN[0]=python_script)
# ---------- viewport_min_max.python (49 lines) ----------
#python nodes in dynamo 1.0
#proposed by Julien Benoit @jbenoit44 
#http://aecuandme.wordpress.com/
import clr
clr.AddReference('ProtoGeometry')
from Autodesk.DesignScript.Geometry import *
# Import ToDSType(bool) extension method
clr.AddReference("RevitNodes")
import Revit
clr.ImportExtensions(Revit.Elements)
# Import geometry conversion extension methods
clr.ImportExtensions(Revit.GeometryConversion)
# Import DocumentManager and TransactionManager
clr.AddReference("RevitServices")
import RevitServices
from RevitServices.Persistence import DocumentManager
from RevitServices.Transactions import TransactionManager
from System.Collections.Generic import *
# Import RevitAPI
clr.AddReference("RevitAPI")
import Autodesk
from Autodesk.Revit.DB import *

doc = DocumentManager.Instance.CurrentDBDocument
uiapp = DocumentManager.Instance.CurrentUIApplication
app = uiapp.Application
uidoc=DocumentManager.Instance.CurrentUIApplication.ActiveUIDocument

elt = []
for i in IN[0]:
	elt.append(UnwrapElement(i))

# Start Transaction
TransactionManager.Instance.EnsureInTransaction(doc)
Min=[]
for v in elt:
	Min.append(v.GetBoxOutline().MinimumPoint.ToPoint(True))

Max=[]
for v in elt:
	Max.append(v.GetBoxOutline().MaximumPoint.ToPoint(True))

Name=[]
for i in elt:
	Name.append(i.Id)
# End Transaction
TransactionManager.Instance.TransactionTaskDone()

OUT=Min,Max,Name
# ----------------------------------------
MINIMUMPOINT = List.FirstItem(viewport_min_max)
lastItem = List.LastItem(ui_multipleinputform.User_Inputs)
code_block_10 = CodeBlock(TemplateSheet=lastItem) { TemplateSheet; }
# note: Haal hier legend en schedule uit of die ook eerst aanmaken
code_block_11 = CodeBlock(a=code_block_10) { Flatten({a}); }

# group: Viewports from template sheet and sort
getViewport_2 = Custom[View.GetViewport](Sheet=code_block_11)
code_block_12 = CodeBlock { "View Name"; }
getParameterValueByName_2 = Element.GetParameterValueByName(element=getViewport_2, parameterName=code_block_12)
flatten = Flatten(getParameterValueByName_2)
flatten_2 = Flatten(getViewport_2)
python_script_2 = Python(IN[0]=flatten, IN[1]=flatten_2)
# ---------- python_script_2.python (14 lines) ----------
import clr
clr.AddReference('ProtoGeometry')
from Autodesk.DesignScript.Geometry import *
#The inputs to this node will be stored as a list in the IN variables.

X = IN[0]
Y = IN[1]

Z = []
for i,j in sorted(zip(X,Y)):
	Z.append(j)

#Assign your output to the OUT variable.
OUT = Z
# ----------------------------------------

viewport_min_max_2 = Python(IN[0]=python_script_2)
# ---------- viewport_min_max_2.python (50 lines) ----------
#python nodes in dynamo 1.0
#proposed by Julien Benoit @jbenoit44 
#http://aecuandme.wordpress.com/
import clr
clr.AddReference('ProtoGeometry')
from Autodesk.DesignScript.Geometry import *
# Import ToDSType(bool) extension method
clr.AddReference("RevitNodes")
import Revit
clr.ImportExtensions(Revit.Elements)
# Import geometry conversion extension methods
clr.ImportExtensions(Revit.GeometryConversion)
# Import DocumentManager and TransactionManager
clr.AddReference("RevitServices")
import RevitServices
from RevitServices.Persistence import DocumentManager
from RevitServices.Transactions import TransactionManager
from System.Collections.Generic import *
# Import RevitAPI
clr.AddReference("RevitAPI")
import Autodesk
from Autodesk.Revit.DB import *

doc = DocumentManager.Instance.CurrentDBDocument
uiapp = DocumentManager.Instance.CurrentUIApplication
app = uiapp.Application
uidoc=DocumentManager.Instance.CurrentUIApplication.ActiveUIDocument

elt = []
for i in IN[0]:
	elt.append(UnwrapElement(i))

# Start Transaction
TransactionManager.Instance.EnsureInTransaction(doc)
Min=[]
for v in elt:
	Min.append(v.GetBoxOutline().MinimumPoint.ToPoint(True))

Max=[]
for v in elt:
	Max.append(v.GetBoxOutline().MaximumPoint.ToPoint(True))

Name=[]
for i in elt:
	Name.append(i.Id)
	
# End Transaction
TransactionManager.Instance.TransactionTaskDone()

OUT=Min,Max
# ----------------------------------------
MINIMUMPOINT_2 = List.FirstItem(viewport_min_max_2)
count = List.Count(getViewport)
code_block_13 = CodeBlock(t1=MINIMUMPOINT_2, n=count) { t2=DSCore.List.OfRepeatedItem(t1,n); t3=Flatten(t2); }
byTwoPoints = Vector.ByTwoPoints(start=MINIMUMPOINT, end=code_block_13.t3)
translate = Geometry.Translate(geometry=viewPortBoxCenter, direction=byTwoPoints)

# group: Set viewport center
setBoxCenter = Custom[Viewport.SetBoxCenter](Points=translate, Viewport_list=python_script)  # API class

viewPortBoxCenter_2 = Custom[View.ViewPortBoxCenter](Viewports=python_script_2)
code_block_14 = CodeBlock(t1=viewPortBoxCenter_2, n=count) { t2=DSCore.List.OfRepeatedItem(t1,n); t3=Flatten(t2); }

# group: Rename SheetName and SheetNumber as Assembly name
element_types = ElementTypes("ViewSheet")
all_elements_of_type = ElementsOfType(element_types)
code_block_15 = CodeBlock { "Assembly: Name"; }
getParameterValueByName_3 = Element.GetParameterValueByName(element=all_elements_of_type, parameterName=code_block_15)
length = String.Length(getParameterValueByName_3)
code_block_16 = CodeBlock { 0; }
gt = length > code_block_16
filterByBoolMask = List.FilterByBoolMask(list=all_elements_of_type, mask=gt)
code_block_17 = CodeBlock { "Sheet Name"; "Sheet Number"; }
filterByBoolMask_2 = List.FilterByBoolMask(list=getParameterValueByName_3, mask=gt)
setParameterByName = Element.SetParameterByName(element=filterByBoolMask.in, parameterName=code_block_17.out1, value=filterByBoolMask_2.in)
setParameterByName_2 = Element.SetParameterByName(element=filterByBoolMask.in, parameterName=code_block_17.out0, value=filterByBoolMask_2.in)

lastItem_2 = List.LastItem(viewport_min_max)
