# Dynamo graph H Schedule.dyn (Dynamo 1.3.3.4111)

# group: INPUT
code_block = CodeBlock { 17; }
code_block_2 = CodeBlock { "KKDE-"; }
view_type = ViewTypesUi("Schedule")
getByType = archilab.Revit.Views.Views.GetByType(view_type)
code_block_3 = CodeBlock()  # // 0 Template Schedule
code_block_4 = CodeBlock()  # // Start nummer
code_block_5 = CodeBlock()  # // Prefix Schedules

code_block_6 = CodeBlock { 18; }
code_block_7 = CodeBlock(a=code_block, n=code_block_6) { a..n; n-a; }
string_from_object = FromObject(code_block_7.out0)
code_block_8 = CodeBlock { 2; "0"; }
padLeft = String.PadLeft(string_from_object, code_block_8.out0, code_block_8.out1)
concat = String.Concat(code_block_2)  # unwired: arg1
map = List.Map(list=padLeft, f_x=concat)
code_block_9 = CodeBlock(a=getByType) { a[19]; }
view_type_2 = ViewTypesUi("Schedule")
getByType_2 = archilab.Revit.Views.Views.GetByType(view_type_2)
code_block_10 = CodeBlock { 23; }
dropItems = List.DropItems(list=getByType_2, amount=code_block_10)
categories = Categories("Assemblies")
all_elements_of_category = ElementsOfCategory(categories)
name = Element.Name(all_elements_of_category)
uniqueItems = List.UniqueItems(name)
schedule_set_filter = Python(IN[0]=code_block_9, IN[1]=dropItems, IN[2]=uniqueItems)  # frozen
# ---------- schedule_set_filter.python (60 lines) ----------
import clr
clr.AddReference('ProtoGeometry')
from Autodesk.DesignScript.Geometry import *


# Import DocumentManager and TransactionManager
clr.AddReference("RevitServices")
import RevitServices
from RevitServices.Persistence import DocumentManager
from RevitServices.Transactions import TransactionManager


# Import RevitAPI
clr.AddReference("RevitAPI")
import Autodesk
from Autodesk.Revit.DB import *


doc = DocumentManager.Instance.CurrentDBDocument
uiapp = DocumentManager.Instance.CurrentUIApplication
app = uiapp.Application


from System.Collections.Generic import *


# Import ToDSType(bool) extension method
clr.AddReference("RevitNodes")
import Revit
clr.ImportExtensions(Revit.Elements)

refschedule = UnwrapElement(IN[0])
tgtschedules = UnwrapElement(IN[1])
tgtstrings = IN[2]

refdefinition = refschedule.Definition
reffilter = refdefinition.GetFilter(1)

tgtdefinitions = []
tgtfilters = []

TransactionManager.Instance.EnsureInTransaction(doc)

a = refdefinition.GetFieldId(0)
b = reffilter.FilterType

for tgtschedule in tgtschedules:
	tgtdefinition = tgtschedule.Definition
	tgtdefinitions.append(tgtdefinition)

for tgtstring in tgtstrings:
	tgtfilter = ScheduleFilter(a, b, tgtstring)
	tgtfilters.append(tgtfilter)

for tgtdefinition, tgtfilter in zip(tgtdefinitions, tgtfilters):
	tgtdefinition.SetFilter(1,tgtfilter)

TransactionManager.Instance.TransactionTaskDone()

OUT = len(tgtdefinitions);
# ----------------------------------------
code_block_11 = CodeBlock()
# ---------- code_block_11.designscript (3 lines) ----------
// 0 Template Schedule
// 1 Target Schedule
// 2 Filter Value
# ----------------------------------------
code_block_12 = CodeBlock()  # // Eind nummer
count = Count(uniqueItems)
ofRepeatedItem = List.OfRepeatedItem(item=code_block_9, amount=count)
duplicate_template_schedule = Python(IN[0]=ofRepeatedItem)
# ---------- duplicate_template_schedule.python (22 lines) ----------
import clr
clr.AddReference('RevitAPI')
from Autodesk.Revit.DB import *
import Autodesk

clr.AddReference("RevitServices")
import RevitServices
from RevitServices.Persistence import DocumentManager
from RevitServices.Transactions import TransactionManager

doc = DocumentManager.Instance.CurrentDBDocument
views = UnwrapElement(IN[0])
elementlist = list()
dupopt = Autodesk.Revit.DB.ViewDuplicateOption.Duplicate

TransactionManager.Instance.EnsureInTransaction(doc)
for view in views:
	newview = view.Duplicate(dupopt)
	elementlist.append(doc.GetElement(newview))
TransactionManager.Instance.TransactionTaskDone()
	
OUT = elementlist
# ----------------------------------------
string = StringInput("View Name")
setParameterByName = Element.SetParameterByName(element=duplicate_template_schedule, parameterName=string, value=uniqueItems)
name_2 = Element.Name(setParameterByName)
scheduleFilters = ScheduleView.ScheduleFilters()  # unwired: arg0
byName = DraftingView.ByName()  # unwired: arg0
schedulableFields = ScheduleView.SchedulableFields()  # unwired: arg0
code_block_13 = CodeBlock(a=schedulableFields) { a[18]; }
schedule_filter_type = ScheduleFilterType("Contains")
code_block_14 = CodeBlock { "WE-02"; }
byFieldTypeAndValue = Revit.Schedules.ScheduleFilter.ByFieldTypeAndValue(field=code_block_13, filterType=schedule_filter_type, value=code_block_14)
addFilters = ScheduleView.AddFilters()  # unwired: scheduleView, scheduleFilters
fields = ScheduleView.Fields()  # unwired: arg0
name_3 = Revit.Schedules.ScheduleField.Name(fields)
filterType = Revit.Schedules.ScheduleFilter.FilterType()  # unwired: arg0
code_block_15 = CodeBlock { "Assembly Name"; }
code_block_16 = CodeBlock {  }
code_block_17 = CodeBlock { 14; }
fields_2 = ScheduleView.Fields()  # unwired: arg0
filedId = Revit.Schedules.ScheduleFilter.FiledId()  # unwired: arg0
name_4 = Revit.Schedules.ScheduleField.Name(code_block_13)
name_5 = Element.Name(getByType_2)
getByType_3 = archilab.Revit.Views.Views.GetByType()  # unwired: arg0
eq = uniqueItems == _  # unwired: arg1
