# Dynamo graph BAG 3D.dyn (Dynamo 1.3.4.6666)

# group: OR USE REVIT SITE LOCATION
code_block = CodeBlock { "4326"; "28992"; }
getRevitSiteLocation = Custom[GIS2BIM.GetRevitSiteLocation]()  # Gets the properties of the current Site Location of the active Revit Project
transformCRS_epsg = Custom[GIS2BIM.TransformCRS_epsg](sourceCRS=code_block.out0, targetCRS=code_block.out1, xCoordinate=getRevitSiteLocation.Lon, yCoordinate=getRevitSiteLocation.Lat)  # Uses the API of http://epsg.io to transform Coordinate Reference Systems

# group: GEOCODING
code_block_2 = CodeBlock { "lange geldersekade"; "2"; "dordrecht"; }
getLocationdataNetherlands = Custom[GIS2BIM.GetLocationdataNetherlands](City=code_block_2.out0, Streetname=code_block_2.out1, Housenumber=code_block_2.out2)  # Gives locationdata based on an adress in the Netherlands

code_block_3 = CodeBlock(RDX=getLocationdataNetherlands.RDcoordinateX_meters_double, RDY=getLocationdataNetherlands.RDcoordinateY_meters_double) { RDX; RDY; }
width_boundingbox = CodeBlock { 300; }

# group: BOUNDINGBOX EN CONSTRUEER WEBREQUEST
createBoundingBox = Custom[GIS2BIM.CreateBoundingBox](CoordinateX=code_block_3.RDX, CoordinateY=code_block_3.RDY, BoxWidth=width_boundingbox, BoxHeight=width_boundingbox)  # create boundingboxstring for webrequests based on coördinates and dimensions
geoservicesLibraryNetherlands = Custom[GIS2BIM.GeoservicesLibraryNetherlands](BoundingBox=createBoundingBox.Boxstring)  # Library with multiple webadresses which can be used for WFS and WMS webrequests

web_request = WebRequest(geoservicesLibraryNetherlands.3D_BAG_TU_Delft_OGC_WFS)

# group: WEBREQUEST & QUERY GML
string = StringInput(".//{3dbag}identificatie")
string_2 = StringInput(".//{3dbag}bouwjaar")
string_3 = StringInput(".//{http://www.opengis.net/gml}posList")
string_4 = StringInput(".//{3dbag}ground-0.00")
string_5 = StringInput(".//{3dbag}ground-0.50")
string_6 = StringInput(".//{3dbag}roof-0.00")
string_7 = StringInput(".//{3dbag}roof-0.50")
string_8 = StringInput(".//{3dbag}roof-0.99")
create = List.Create(string, string_2, string_3, string_4, string_5, string_6, string_7, string_8)
XMLXPath = Custom[GIS2BIM.XMLXPath](XMLString=web_request, XPathStrings=create)  # Run an XPathquery on an xml-string

# group: CONVERT GML TO POINTS
code_block_4 = CodeBlock { "_none"; "0"; }
replace = String.Replace(str=XMLXPath, searchFor=code_block_4.out0, replaceWith=code_block_4.out1)
code_block_5 = CodeBlock(a=replace) { polygons=a[2]; bottom=a[4]; top=a[7]; }
code_block_6 = CodeBlock(rdx=code_block_3.RDX, rdy=code_block_3.RDY) { rdx; rdy; peil_NAP; }  # unwired: peil_NAP
code_block_7 = CodeBlock(t8=code_block_5.polygons, rdx=code_block_6.rdx, rdy=code_block_6.rdy, zbottom=code_block_5.bottom, ztop=code_block_5.top)
# ---------- code_block_7.designscript (9 lines) ----------
t7 = String.Split(t8, {" "});
t9 = DSCore.List.DropEveryNthItem(t7@-2<1>, 3, 0);
rdxlist = DSCore.String.ToNumber(DSCore.List.DropEveryNthItem(t9@-2<1>, 2, 0));
rdylist = DSCore.String.ToNumber(DSCore.List.DropEveryNthItem(t9@-2<1>, 2, 1));
xlocal= DSCore.Math.Round(1000*(rdxlist-rdx));
ylocal= DSCore.Math.Round(1000*(rdylist-rdy));
zlocalbottom=1000*(DSCore.String.ToNumber(zbottom));
zlocaltop=1000*(DSCore.String.ToNumber(ztop));
thickness=zlocaltop-zlocalbottom;
# ----------------------------------------

# group: CREATE SOLID GEOMETRY
byCoordinates = Point.ByCoordinates(x=code_block_7.xlocal, y=code_block_7.ylocal, z=code_block_7.zlocalbottom)
byPoints = PolyCurve.ByPoints(points=byCoordinates)
byPatch = Surface.ByPatch(byPoints)
boolean = BoolSelector(false)
thicken = Surface.Thicken(surface=byPatch, thickness=code_block_7.thickness, both_sides=boolean)

isNull = Object.IsNull(thicken)
filterByBoolMask = List.FilterByBoolMask(list=thicken, mask=isNull)
byUnion = Solid.ByUnion(filterByBoolMask.out)
file_path = Filename(".\Metric Mass.rft")

# group: PLACE FAMILY
code_block_8 = CodeBlock { "NLRS_90_MA_BAG_3D.rfa"; ".rfa"; }
categories = Categories("Mass")
code_block_9 = CodeBlock { "Form"; }
byGeometry = Custom[Springs.FamilyInstance.ByGeometry](geometry=byUnion, familyTemplatePath=file_path, familyName=code_block_8.out0, category=categories, subcategoryName=code_block_9)  # You must provide a valid family template path that will be used for all input geometry objects. The project units(and not the templates) will be used to determine the size of the output geometry. The provided category will be used only if the family template supports it. If not, the default template category will be used instead. Likewise, the family material(provided as a string) will be set only if a material with that name exists in the template. If not, the default material will be used instead ("By Category"). For void cuts, the material settings will be ignored. The Subcategory name is an optional input. If you'd like to skip assigning a Subcategory to any new instance, simply use null. The node expects a unique family name for each geometry object. The rest of the input lists will be processed as if the node lacing is set to longest.

# group: DISPLAY YEAR OF CONSTRUCTION IN COLOR
code_block_10 = CodeBlock { 237; 28; 36; 128; 128; 128; }
byARGB = Color.ByARGB(r=code_block_10.out0, g=code_block_10.out1, b=code_block_10.out2)
byARGB_2 = Color.ByARGB(r=code_block_10.out3, g=code_block_10.out4, b=code_block_10.out5)
create_2 = List.Create(byARGB, byARGB_2)
code_block_11 = CodeBlock { 0; 1; }
create_3 = List.Create(code_block_11.out0, code_block_11.out1)
code_block_12 = CodeBlock(a=XMLXPath)
# ---------- code_block_12.designscript (9 lines) ----------
bouwdatum=a[1];
gesplitst=String.Split(bouwdatum, {"-"});
bouwjaar=List.FirstItem(gesplitst@-2<1>);
bouwjaarNumb= String.ToNumber(bouwjaar);
oudste = String.ToNumber(List.MinimumItem(bouwjaar));
jongste = String.ToNumber(List.MaximumItem(bouwjaar));
range = jongste-oudste;
t2 = bouwjaarNumb-oudste;
t3 = t2/range;
# ----------------------------------------
color_range = ColorRange(create_2, create_3, code_block_12.t3)
byGeometryColor = Display.Display.ByGeometryColor(thicken, color_range)

code_block_13 = CodeBlock()
# ---------- code_block_13.designscript (4 lines) ----------
//MATERIAL FOR TOPOGRAPHY
//MUST HAVE RENDERAPPAERANCE 'GENERIC'
//RENDERAPPAEANCE NOT READ ONLY(DUPLICATE OF
"Default Ground Plane";
# ----------------------------------------
code_block_14 = CodeBlock { "C:/TEMP/map.jpg"; }
code_block_15 = CodeBlock()
# ---------- code_block_15.designscript (2 lines) ----------
//number of pixels Geotiff
"200";
# ----------------------------------------
code_block_16 = CodeBlock()
# ---------- code_block_16.designscript (2 lines) ----------
//temp filepath Geotiff
"C:/TEMP/test19.tiff";
# ----------------------------------------
code_block_17 = CodeBlock()
# ---------- code_block_17.designscript (10 lines) ----------
//CHOOSE AHN-LAYER

//maaiveld resolutie 0.5 m
"ahn3_05m_dtm";
//maaiveld+bomen+gebouwen enz. resolutie 0.5 m
"ahn3_05m_dsm";
//maaiveld resolutie 5 m
"ahn3_5m_dtm";
//maaiveld+bomen+gebouwen enz. resolutie 5 m
"ahn3_5m_dsm";
# ----------------------------------------

# group: TOPOGRAPHY USING AHN3 GEOTIFF WCS
AHN3toPoints = Custom[GIS2BIM.AHN3toPoints](Rdx=getLocationdataNetherlands.RDcoordinateX_meters_double, Rdy=getLocationdataNetherlands.RDcoordinateY_meters_double, BoundinxboxWidth=width_boundingbox, ResolutionGeotiff=code_block_15, FilepathName=code_block_16, Layer=code_block_17.out0)  # Load AHN3 via Geotiff WCS. Transform to local coordinates
byPoints_2 = Topography.ByPoints(AHN3toPoints)

# group: WEB MAP SERVICE WEB REQUEST FOR AERIALPHOTO AND SET RENDERMATERIAL
byName = Material.ByName(code_block_13)
webrequestWMS2 = Custom[GIS2BIM.WebrequestWMS2](WMSwebrequest=geoservicesLibraryNetherlands.luchtfoto_2018_OGC_WMS)  # a webrequest based on WMS-protocol
boolean_2 = BoolSelector(true)
boolean_3 = BoolSelector(false)
code_block_18 = CodeBlock { 270; }
bitmapRotateFlip = Custom[GIS2BIM.BitmapRotateFlip](Bitmap=webrequestWMS2, FlipX=boolean_2, FlipY=boolean_3, RotationFlip=code_block_18)  # Rotate and/or flip a bitmap/image
systemDrawingBitmapToJPG = Custom[GIS2BIM.SystemDrawingBitmapToJPG](SystemDrawingBitmap=bitmapRotateFlip.Bitmap, FileName=code_block_14)  # Save an System.Drawing.Bitmap object as a jpg-file
code_block_19 = CodeBlock(b=width_boundingbox) { 0; (b*1000)*2.54; 0; }
boolean_4 = BoolSelector(false)
setMaterialAppearanceTextureGeneric = Custom[GIS2BIM.SetMaterialAppearanceTextureGeneric](Material=byName, TextureFilelocation=systemDrawingBitmapToJPG, TextureOffsetX=code_block_19.out0, TextureOffsetY=code_block_19.out0, TextureSizeXMM=code_block_19.out1, TextureSizeYMM=code_block_19.out1, LockScale=boolean_4, RotationAngle=code_block_19.out2)  # Change the values of the texture of the appearanceasset of a Revit Material of the type 'generic'
code_block_20 = CodeBlock { "Material"; }
setParameterByNameTypeOrInstance = Rhythm.Revit.Elements.Elements.SetParameterByNameTypeOrInstance(byPoints_2, code_block_20, byName)

code_block_21 = CodeBlock { "dordrecht"; "2"; "lange geldersekade"; }
code_block_22 = CodeBlock { "gouda"; "58"; "gouderaksedijk"; }
code_block_23 = CodeBlock { "boskoop"; "2"; "gouderaksedijk"; }
