# Dynamo graph Location Analysis 2D maps.dyn (Dynamo 1.3.4.6666)

# group: 3. GEOCODING
code_block = CodeBlock { "dordrecht"; "lange geldersekade"; "2"; }
getLocationdataNetherlands = Custom[GIS2BIM.GetLocationdataNetherlands](City=code_block.out0, Streetname=code_block.out1, Housenumber=code_block.out2)  # Gives locationdata based on an adress in the Netherlands
openBrowser = Custom[GIS2BIM.OpenBrowser]()  # Opens a new window in your default browser with the given url.; unwired: url
watch = Watch(getLocationdataNetherlands.URLWebrequest)

# group: 4 Web Map Service
code_block_2 = CodeBlock { bs=150; bm=10000; bl=75000; ratio=1; hs=bs*ratio; hm=bm*ratio; hl=bl*ratio; }
createBoundingBox = Custom[GIS2BIM.CreateBoundingBox](CoordinateX=getLocationdataNetherlands.RDcoordinateX_meters_double, CoordinateY=getLocationdataNetherlands.RDcoordinateY_meters_double, BoxWidth=code_block_2.bm, BoxHeight=code_block_2.hm)  # create boundingboxstring for webrequests based on coördinates and dimensions
geoservicesLibraryNetherlands = Custom[GIS2BIM.GeoservicesLibraryNetherlands](BoundingBox=createBoundingBox.Boxstring)  # Library with multiple webadresses which can be used for WFS and WMS webrequests
createBoundingBox_2 = Custom[GIS2BIM.CreateBoundingBox](CoordinateX=getLocationdataNetherlands.RDcoordinateX_meters_double, CoordinateY=getLocationdataNetherlands.RDcoordinateY_meters_double, BoxWidth=code_block_2.bl, BoxHeight=code_block_2.hl)
geoservicesLibraryNetherlands_2 = Custom[GIS2BIM.GeoservicesLibraryNetherlands](BoundingBox=createBoundingBox_2.Boxstring)
createBoundingBox_3 = Custom[GIS2BIM.CreateBoundingBox](CoordinateX=getLocationdataNetherlands.RDcoordinateX_meters_double, CoordinateY=getLocationdataNetherlands.RDcoordinateY_meters_double, BoxWidth=code_block_2.bs, BoxHeight=code_block_2.hs)
geoservicesLibraryNetherlands_3 = Custom[GIS2BIM.GeoservicesLibraryNetherlands](BoundingBox=createBoundingBox_3.Boxstring)
create = List.Create(geoservicesLibraryNetherlands.luchtfoto_2018_OGC_WMS, geoservicesLibraryNetherlands_2.luchtfoto_2018_OGC_WMS, geoservicesLibraryNetherlands_3.5_luchtfoto_2016_OGC_WMS, geoservicesLibraryNetherlands_3.Luchtfoto_2017_OGC_WMS, geoservicesLibraryNetherlands_3.luchtfoto_2018_OGC_WMS, geoservicesLibraryNetherlands.Geluidscontouren_alle_bronnen_OGC_WMS, geoservicesLibraryNetherlands_3.10_bestemmingsplan_bouwvlak_OGC_WMS, geoservicesLibraryNetherlands_3.12_ruimtelijkeplannen_OGC_WMS, geoservicesLibraryNetherlands_3.6_CBS_WOZ_2011_100m_OGC_WMS, geoservicesLibraryNetherlands_3.6_legenda)
python_script = Python(IN[0]=create)
# ---------- python_script.python (20 lines) ----------
import sys
sys.path.append("C:\Program Files (x86)\IronPython 2.7\Lib")

import clr

clr.AddReference("System.Drawing")
clr.AddReference("System")
from System.Drawing import Image
from System.Net import WebRequest

urls= IN[0]

bitmaps = []

for i in urls:
	request = WebRequest.Create(i)
	response = request.GetResponse()
	bitmaps.append(Image.FromStream(response.GetResponseStream()))

OUT = bitmaps
# ----------------------------------------

# group: 5 WEB MAP TILE SERVICES
code_block_3 = CodeBlock { 14; 8; 4; }
code_block_4 = CodeBlock(s=code_block_3.out0, m=code_block_3.out1, l=code_block_3.out2) { s; m; l; s; s; s; m; m; m; }
create_2 = List.Create(code_block_4.out0, code_block_4.out1, code_block_4.out2, code_block_4.out3, code_block_4.out4, code_block_4.out5, code_block_4.out6, code_block_4.out7, code_block_4.out8)
code_block_5 = CodeBlock(s=code_block_2.bs, m=code_block_2.bm, l=code_block_2.bl) { s; m; l; s; s; s; m; m; m; s; }
create_3 = List.Create(code_block_5.out0, code_block_5.out1, code_block_5.out2, code_block_5.out3, code_block_5.out4, code_block_5.out5, code_block_5.out6, code_block_5.out7, code_block_5.out8)
code_block_6 = CodeBlock()
# ---------- code_block_6.designscript (9 lines) ----------
"opentopo";
"opentopo";
"opentopo";
"bgtstandaard";
"kadastralekaartv3";
"ahn3_05m_dsm";
"geomorfologischekaart50000";
"bodemkaart50000";
"natura2000";
# ----------------------------------------
create_4 = List.Create(code_block_6.out0, code_block_6.out1, code_block_6.out2, code_block_6.out3, code_block_6.out4, code_block_6.out5, code_block_6.out6, code_block_6.out7, code_block_6.out8)

python_script_2 = Python(IN[0]=create_2, IN[1]=getLocationdataNetherlands.RDcoordinateX_meters_double, IN[2]=getLocationdataNetherlands.RDcoordinateY_meters_double, IN[3]=create_3, IN[4]=create_4)
# ---------- python_script_2.python (210 lines) ----------
import clr
clr.AddReference('ProtoGeometry')
clr.AddReference("System.Drawing")
clr.AddReference("System")
from System import Drawing
from System.Drawing import Image
from System.Drawing import Bitmap
from System.Drawing import Graphics
from System.Drawing.Imaging import ImageFormat
from System.Net import WebRequest
from System.IO import Path
#from os import listdir
import sys
sys.path.append("C:\Program Files (x86)\IronPython 2.7\Lib")

from Autodesk.DesignScript.Geometry import *
#The inputs to this node will be stored as a list in the IN variables.

import math
from math import *
import itertools
from itertools import islice

dataEnteringNode = IN

Zoomlevels = IN[0]
Rdx = IN[1]
Rdy = IN[2]
BoundingboxWidths = IN[3]
Layers = IN[4]

Zoomleveldata = {0:3440.640,
1:1720.320,
2:860.160,
3:430.080,
4:215.040,
5:107.520,
6:53.720,
7:26.880,
8:13.440,
9:6.720,
10:3.360,
11:1.680,
12:0.840,
13:0.420,
14:0.210,
15:0.105,
16:0.0575}

PixelWidth =256
Xcorner=-285401.92
Ycorner=903402.0

Resolutions = []
for i in Zoomlevels:
	Resolutions.append(Zoomleveldata[i])

TileColumns = []
TileRows = []
DeltaX = []
DeltaY= []

for i in Resolutions:
	a = PixelWidth*i
	#TileColumns.append(Rdx-Xcorner)
	#TileRows.append(a)
	TileY = (Ycorner-Rdy)/a
	TileX = (Rdx-Xcorner)/a
	TileYRound = int(TileY)
	TileXRound = int(TileX)
	TilePercentageY = TileX-TileXRound
	TilePercentageX = TileY-TileYRound
	DeltaYM = TilePercentageY*PixelWidth*i
	DeltaXM = TilePercentageX*PixelWidth*i
	
	TileRows.append(TileYRound)
	TileColumns.append(TileXRound)
	DeltaY.append(DeltaYM)
	DeltaX.append(DeltaXM)

UniqueTileColumns = []
UniqueTileRows = []
TileColumns2 = []
TileRows2 = []

for i,j,k,l in zip(TileColumns, TileRows, BoundingboxWidths, Resolutions):
	TileWidth=PixelWidth*l
	c = math.ceil(k/TileWidth)
	b = math.ceil(c/2)*2
	UniqueTileColumns.append(range(int((i-b/2)), 1+int(i+b/2)))
	UniqueTileRows.append(range((int(j-b/2)), 1+int(j+b/2)))


for i in UniqueTileColumns:
	#de list:
	a = []
	
	counter = len(i)
	
	for j in i: #elke unieke tile
		a.append(i)
	flatA= []
	
	for sublist in a:
		for item in sublist:
			flatA.append(item)
	TileColumns2.append(flatA)
	
	counter=0

for i in UniqueTileRows:
	#de list:
	a = []
	
	counter = len(i)
	for j in i: #elke unieke tile
		a.append([int(j)]*counter)
	flatA= []
	
	for sublist in a:
		for item in sublist:
			flatA.append(item)
	TileRows2.append(flatA)
	
	counter=0

TotalTileWidth = []

for i, j in zip(Resolutions,UniqueTileColumns):
	a = len(j)*PixelWidth*i
	TotalTileWidth.append(a)

string1 = "http://geodata.nationaalgeoregister.nl/tiles/service/wmts?&request=GetTile&VERSION=1.0.0&LAYER="
string3 = "&STYLE=default&TILEMATRIXSET=EPSG:28992&TILEMATRIX=EPSG:28992:"
string34 = "&TILEROW="
string5 = "&TILECOL="
string7 = "&FORMAT=image/png8";

urlList = []

for i,j,k,z in zip(TileColumns2,TileRows2,Layers,Zoomlevels):
	a = []
	for l,m in zip(i,j):
		b = string1 + str(k) + string3 + str(z) + string34 + str(m) + string5 + str(l) + string7
		a.append(b)
	urlList.append(a)

bitmaps2 = []


for i in urlList:
	bitmaps = []
	for j in i:
		request = WebRequest.Create(j)
		request.Accept = "text/html"
		request.UserAgent = "Mozilla/5.0"
		response = request.GetResponse()
		bitmaps.append(Image.FromStream(response.GetResponseStream()))
	bitmaps2.append(bitmaps)

combinedBitmaps = []
for a,b,c in zip(bitmaps2,UniqueTileColumns,UniqueTileRows):
	TotalWidth = len(b)*PixelWidth
	TotalHeight = len(c)*PixelWidth
	img = Bitmap(TotalWidth,TotalHeight)
	g = Graphics.FromImage(img)
	LPx = []
	n = 0
	for l in j:
		LPx.append(n*PixelWidth)
		n=n+1
	
	LPy = []
	n = 0
	for i in c:
		LPy.append(n*PixelWidth)
		n=n+1

	LPx2=[]
	n=len(LPy)
	for i in LPx:
		LPx2.append([i]*n)

	LPx3=[]
	for sublist in LPx2:
		for item in sublist:
			LPx3.append(item)

	LPy2=[]
	for i in LPx:
		LPy2.append(LPy)

	LPy3=[]
	for sublist in LPy2:
		for item in sublist:
			LPy3.append(item)
        
	LPy4=reversed(LPy3)

	for m,n,o in zip(a,LPy3,LPx3):
		g.DrawImage(m,n,o)
	combinedBitmaps.append(img)

	#else:
	#	for i,j,k in zip(bitmaps,LPx3,LPy4):
	#		g.DrawImage(i,j,k)
	
combinedBitmaps
#Assign your output to the OUT variable.
OUT = combinedBitmaps
# ----------------------------------------

# group (continued): 5 WEB MAP TILE SERVICES
code_block_7 = CodeBlock(a=python_script_2) { a[0]; a[1]; a[2]; a[3]; a[4]; a[5]; a[6]; a[7]; a[8]; }
watch_image = WatchImageCore(code_block_7.out1)
watch_image_2 = WatchImageCore(code_block_7.out2)
watch_image_3 = WatchImageCore(code_block_7.out3)
watch_image_4 = WatchImageCore(code_block_7.out5)
watch_image_5 = WatchImageCore(code_block_7.out6)
watch_image_6 = WatchImageCore(code_block_7.out0)
watch_image_7 = WatchImageCore(code_block_7.out4)
create_5 = List.Create(watch_image_6, watch_image_7)
mergeImages = Custom[GIS2BIM.MergeImages](images=create_5)  # Merges a list of images to 1 image
watch_image_8 = WatchImageCore(mergeImages)
watch_image_9 = WatchImageCore(code_block_7.out7)
watch_image_10 = WatchImageCore(code_block_7.out8)

# group: 4 Web Map Service(WMS)
code_block_8 = CodeBlock(a=python_script) { a[0]; a[1]; a[2]; a[3]; a[4]; a[5]; a[6]; a[7]; a[8]; a[9]; }
watch_image_11 = WatchImageCore(code_block_8.out0)
watch_image_12 = WatchImageCore(code_block_8.out2)
watch_image_13 = WatchImageCore(code_block_8.out1)
watch_image_14 = WatchImageCore(code_block_8.out3)
watch_image_15 = WatchImageCore(code_block_8.out5)
watch_image_16 = WatchImageCore(code_block_8.out4)
watch_image_17 = WatchImageCore(code_block_8.out6)
watch_image_18 = WatchImageCore(code_block_8.out7)
watch_image_19 = WatchImageCore(code_block_8.out8)
watch_image_20 = WatchImageCore(code_block_8.out9)

webrequestWMS2 = Custom[GIS2BIM.WebrequestWMS2](WMSwebrequest=geoservicesLibraryNetherlands_3.Luchtfoto_2017_OGC_WMS)  # a webrequest based on WMS-protocol
watch_image_21 = WatchImageCore(webrequestWMS2)

# group: COORDINATE REFERENCE SYSTEMS
code_block_9 = CodeBlock { "28992"; }
searchCRS = Custom[GIS2BIM.SearchCRS](EPSG_Code=code_block_9)  # Search for a Coordinate Reference System
code_block_10 = CodeBlock { "4326"; "28992"; }
doubleToString = Custom[GIS2BIM.DoubleToString](CoordinateDouble=getLocationdataNetherlands.RDcoordinateX_meters_double)  # Converts a double to a string
doubleToString_2 = Custom[GIS2BIM.DoubleToString](CoordinateDouble=getLocationdataNetherlands.RDcoordinateY_meters_double)
transformCRS_epsg = Custom[GIS2BIM.TransformCRS_epsg](sourceCRS=code_block_10.out1, targetCRS=code_block_10.out0, xCoordinate=doubleToString, yCoordinate=doubleToString_2)  # Uses the API of http://epsg.io to transform Coordinate Reference Systems

code_block_11 = CodeBlock()
# ---------- code_block_11.designscript (2 lines) ----------
http://rvo.b3p.nl/geoserver/CBSEnergieData/wms?&request=GetCapabilities&service=WMS
https://geodata.nationaalgeoregister.nl/bevolkingskernen2008/wms?&request=GetCapabilities&service=WMS
# ----------------------------------------
code_block_12 = CodeBlock { "to do"; }
getMortonCodeCoordinate = Custom[GIS2BIM.GetMortonCodeCoordinate]()  # Get mortoncode(bitshifting) given 2 coordinates and tiledimension; unwired: X, Y
code_block_13 = CodeBlock { "dordrecht"; "lange geldersekade"; "2"; }
